# Grasshopper definition 02 Getting Geometry.gh (Grasshopper 0.9.76)
# plug-ins: Embryo

# The number of component copies affects the probability of it being selected.
# You can only put components in here (not parameters),
# They can be any compiled component, including custom ones.
# It doesn't matter if the component has a warning.
# At present, the persistent data is always by default although this will change in future.
# Any disabled components will be ignored.
pt = ConstructPoint(XCoordinate=0, YCoordinate=0, ZCoordinate=0)
pt_2 = ConstructPoint(XCoordinate=0, YCoordinate=0, ZCoordinate=0)
box = Box2Pt(Plane=PlaneXY(0, 0, 0))
rotate = Rotate(Angle=1.570796327, Plane=PlaneXY(0, 0, 0))  # -> Geometry, Transform
# Here is where your definition will be generated.
# If any components are located here that have been made manually (i.e. not by Embryo),
# they will be included individually in the generated definition.
# The generation is topologically sorted (i.e. each column is a dependency hierarchy)
# example 001
# The canvas is divided into quadrants.
# The parent canvas (this bit) is as per usual.
# The ingredients quadrant contains components to be used in the generated definition.
# The child quadrant is where the generated definition lies.
# The other quadrant is where dragons live.
xz = XZPlane(Origin=Point(0, 0, 0))
# Set to True
toggle = BooleanToggle(False)
# The metric, topological and function genes can be negated using a random override seed.
# With the override, you can supply gene pools to the above (see later examples).
# This is useful for combining definitions with metaheuristic algorithms.
number_slider = Slider(6328, range=0..10000)
embryo = EmbryoSettings(
    Preview=toggle,
    SliderDomain=Domain(-10, 10),
    OneToOne=Toggle(True),
    GridX=120,
    GridY=120,
    RemoveDead=True,
    OnlyTerminals=False)
# A parent output tag lets Embryo know that the parameter could  _potentially_ be included in the definiiton
parent_output = ParentOutput(O=xz)
embryo_2 = Embryo(
    Reset=Toggle(False),
    Sliders=Slider(16, range=0..100),
    Components=Slider(32, range=0..100),
    MetricGenes=2,
    TopologyGenes=2,
    FunctionGenes=2,
    Settings=embryo,
    RandomOveride=number_slider)  # -> Iterations, Components
# Step through the definition with the cognise tools.
# Tweak the slider and see the generated definition preview change.
number_slider_2 = Slider(-1, range=-1..10)
colstep = ColumnStep(Components=embryo_2.Components, LastColumn=number_slider_2)
get_geometry = GetGeometry()
# The getgeometry component will get any geometry from the generated definition.
# This is brought back to the main canvas.
swatch = ColourSwatch(SwatchColor=RGB(255, 255, 255))
volume = Volume(Geometry=get_geometry)  # -> Volume, Centroid
preview = CustomPreview(Geometry=get_geometry, Shader=swatch)
dispatch = Dispatch(List=get_geometry, DispatchPattern=volume.Volume)  # -> ListA, ListB
edges = BrepEdges(Brep=dispatch.ListA)  # -> Naked, Interior, NonManifold
preview_2 = CustomPreview(Geometry=edges.Interior, Shader=ColourSwatch(SwatchColor=RGB(0, 0, 0)))
