# Grasshopper definition 03 Embryo with Galapagos.gh (Grasshopper 1.0.7)
# plug-ins: Embryo

addition = Addition()
subtraction = Subtraction()
multiplication = Multiplication()
slider = Slider(4, range=0..4)
slider_2 = Slider(5, range=0..5)
slider_3 = Slider(6, range=0..6)
slider_4 = Slider(7, range=0..7)
slider_5 = Slider(25, range=0..25)
# In this example, we use Embryo to solve a combinatorial problem (from the gameshow Countdown).
# How to reach a target number (314) with the numbers on the left using basic operators.
# As the numbers to use are already known, these are on the parent canvas and tagged as outputs to be used.
# Double-click on the galapagos component to start, making sure to minimise the error.
slider_6 = Slider(50, range=0..50)
embryo = EmbryoSettings(
    Preview=True,
    SliderDomain=Domain(-10, 10),
    OneToOne=Toggle(True),
    GridX=100,
    GridY=70,
    RemoveDead=False,
    OnlyTerminals=False)
genes = GenePool(Decimals=0, Maximum=3, Minimum=0, Value=[2, 2, 2, 2, 2])
genes_2 = GenePool(Decimals=0, Maximum=12, Minimum=0, Value=[4, 10, 7, 0, 4, 3, 10, 2, 10, 1])
parent_output = ParentOutput(O=[slider, slider_2, slider_3, slider_4, slider_5, slider_6])
g_a_b = Multiplication(A=slider_3, B=slider_4)
g_a_b_2 = Multiplication(A=slider_2, B=slider_6)
embryo_2 = Embryo(
    Reset=Toggle(True),
    Sliders=Slider(0, range=0..100),
    Components=Slider(5, range=0..10),
    MetricGenes=2,
    TopologyGenes=genes_2,
    FunctionGenes=genes,
    Settings=embryo,
    RandomOveride=0)  # -> Iterations, Components
g_a_b_3 = Multiplication(A=g_a_b_2, B=slider)
g_a_b_4 = Multiplication(A=g_a_b_3, B=slider_5)
parent_input = ParentInput()
g_a_b_5 = Multiplication(A=g_a_b, B=g_a_b_4)
int = Integer([parent_input, g_a_b_5])
subtraction_2 = Subtraction(A="314", B=int)
abs = Absolute(Value=subtraction_2)
galapagos = Galapagos(fitness=abs, gene=[genes_2, genes])
panel = Panel(abs)
