# Grasshopper definition 04 Analysising Shapes.gh (Grasshopper 1.0.7)
# plug-ins: Embryo

box = Box2Pt(Plane=PlaneXY(0, 0, 0))
box_2 = Box2Pt(Plane=PlaneXY(0, 0, 0))
divide = DivideCurve(Count=10, Kinks=False)  # -> Points, Tangents, Parameters
ln = Line()
pt = ConstructPoint(XCoordinate=0, YCoordinate=0, ZCoordinate=0)
pt_2 = ConstructPoint(XCoordinate=0, YCoordinate=0, ZCoordinate=0)
# Gene pool contains same number of sliders
# (cannot be attached to slider unfortunately).
# Values correspond to slider values.
genes = GenePool(Decimals=0, Maximum=60, Minimum=0, Value=[51, 36, 60, 41, 33, 44, 7, 17, 9, 18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])
genes_2 = GenePool(Decimals=2, Maximum=10, Minimum=-10, Value=[-4.91, 2.53, -1.74, 2.89, -10, 4.43, -9.69, 8.05])
# Gene pool contains same number of Component inputs.
# A decent guess is no. of components x 3, which for this example is 60.
# Min = 0. Max = 60.
# Gene pool contains same number of Components which for this example is 20.
# Range corresponds to the number of ingredient components:
# Min = 0. Max = 5.
genes_3 = GenePool(Decimals=0, Maximum=6, Minimum=0, Value=[0, 6, 1, 4, 1, 3, 4, 2, 5, 2, 0, 4, 1, 5, 0, 6, 5, 2, 1, 0])
g_slider7 = Slider(8.05, range=-10..10)
g_slider6 = Slider(-9.69, range=-10..10)
g_slider5 = Slider(4.43, range=-10..10)
g_slider4 = Slider(-10, range=-10..10)
g_slider3 = Slider(2.89, range=-10..10)
g_slider2 = Slider(-1.74, range=-10..10)
g_slider1 = Slider(2.53, range=-10..10)
g_slider0 = Slider(-4.91, range=-10..10)
embryo = EmbryoSettings(Preview=False, SliderDomain=Domain(-10, 10), OneToOne=False, GridX=160, GridY=120, RemoveDead=True, OnlyTerminals=False)
g_pt = ConstructPoint(XCoordinate=g_slider6, YCoordinate=g_slider4, ZCoordinate=g_slider5)
g_pt_2 = ConstructPoint(XCoordinate=g_slider1, YCoordinate=g_slider0, ZCoordinate=g_slider2)
g_pt_3 = ConstructPoint(XCoordinate=g_slider6, YCoordinate=g_slider0, ZCoordinate=g_slider3)
g_pt_4 = ConstructPoint(XCoordinate=g_slider3, YCoordinate=g_slider0, ZCoordinate=g_slider1)
g_pt_5 = ConstructPoint(XCoordinate=g_slider2, YCoordinate=g_slider5, ZCoordinate=g_slider3)
g_pt_6 = ConstructPoint(XCoordinate=g_slider4, YCoordinate=g_slider2, ZCoordinate=g_slider1)
g_pt_7 = ConstructPoint(XCoordinate=g_slider1, YCoordinate=g_slider3, ZCoordinate=g_slider2)
g_pt_8 = ConstructPoint(XCoordinate=g_slider3, YCoordinate=g_slider1, ZCoordinate=g_slider0)
embryo_2 = Embryo(
    Reset=Toggle(True),
    Sliders=Slider(8, range=0..10),
    Components=Slider(20, range=0..100),
    MetricGenes=genes_2,
    TopologyGenes=genes,
    FunctionGenes=genes_3,
    Settings=embryo,
    RandomOveride=0)  # -> Iterations, Components
g_ln = Line(StartPoint=g_pt_8, EndPoint=g_pt_5)
g_ln_2 = Line(StartPoint=g_pt_6, EndPoint=g_pt_8)
g_box = Box2Pt(PointA=g_pt_5, PointB=g_pt_7, Plane=g_pt_8)
g_ln_3 = Line(StartPoint=g_pt_8, EndPoint=g_pt_6)
g_box_2 = Box2Pt(PointA=g_pt_6, PointB=g_pt_8, Plane=g_pt_7)
g_divide = DivideCurve(Curve=g_ln_3, Count=g_slider7, Kinks=False)  # -> Points, Tangents, Parameters
g_pt_9 = ConstructPoint(XCoordinate=g_slider0, YCoordinate=g_slider4, ZCoordinate=g_divide.Parameters)
g_box_3 = Box2Pt(PointA=g_divide.Points, PointB=g_pt_4, Plane=g_pt_8)
g_box_4 = Box2Pt(PointA=g_divide.Points, PointB=g_pt_7, Plane=g_pt_4)
parent_input = ParentInput()
brep = Brep([parent_input, g_box])
brep_2 = Brep([parent_input, g_box_4])
brep_3 = Brep([parent_input, g_box_2])
brep_4 = Brep([parent_input, g_box_3])
brep_5 = Brep([brep_2, brep_3, brep_4, brep])
rgb = ColourRGB(Alpha=150, Red=255, Green=0, Blue=0)

# ---- group: Target Geometry
mesh = Mesh([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])
demesh = DeconstructMesh(Mesh=mesh)  # -> flatten(Vertices), Faces, Colours, Normals
sort_pt = SortPoints(Points=demesh.Vertices)  # -> Points, Indices

# ---- group: Generated Geometry
clean = CleanTree(Tree=brep_5, CleanInvalid=True, CleanEmpty=False)
mesh_2 = MeshBrep(
    Brep=clean,
    Settings={GridMaxCount=0, GridMinCount=16, JaggedSeams=False, MaxEdgeLength=0, MinEdgeLength=0.0001, MinTolerance=0, Refine=True, RefineAngle=0, RelativeTolerance=0.65, SimplePlanes=True, Tolerance=0})
demesh_2 = DeconstructMesh(Mesh=mesh_2)  # -> flatten(Vertices), Faces, Colours, Normals
preview = CustomPreview(
    Geometry=mesh_2,
    Shader={diffuse=RGB(255, 105, 180), emission=RGB(76, 32, 54), shine=0.5, specular=RGB(255, 255, 255), transparency=0})
sort_pt_2 = SortPoints(Points=demesh_2.Vertices)  # -> Points, Indices

# ----
preview_2 = CustomPreview(Geometry=mesh, Shader=rgb)
cp = ClosestPoint(Point=sort_pt.Points, Cloud=sort_pt_2.Points)  # -> ClosestPoint, CPIndex, Distance
dist = Distance(PointA=cp.ClosestPoint, PointB=sort_pt.Points)

# ---- group: Penalise Zero Result
ma = MassAddition(Input=dist)  # -> Result, PartialResults
larger = LargerThan(FirstNumber=ma.Result, SecondNumber=0)  # -> LargerThan, OrEqualTo
filter = StreamFilter(Gate=larger.LargerThan, Stream0=Slider(100000, range=0..100000), Stream1=ma.Result)

# ----
one_over_x = OneOverX(Value=filter)

# ---- group: Maximise this
addition = Addition(A=one_over_x, B=Slider(0, range=0..1))

# ----
galapagos = Galapagos(fitness=addition, gene=[genes_3, genes, genes_2])
