# Grasshopper definition 05 Inputs and Outputs.gh (Grasshopper 1.0.7)
# plug-ins: Embryo

debrep = DeconstructBrep()  # -> Faces, Edges, Vertices
box = CenterBox(Base=PlaneXY(0, 0, 0), X=1, Y=1, Z=1)

# ---- group: These can be adjusted after definition is generated
number_slider = Slider(32, range=0..100)
number_slider_2 = Slider(32, range=0..100)
number_slider_3 = Slider(0.5, range=0..1)

# ----
pt = ConstructPoint(XCoordinate=0, YCoordinate=0, ZCoordinate=0)
g_slider5 = Slider(2.943, range=-10..10)
g_slider4 = Slider(-6.624, range=-10..10)
g_slider3 = Slider(-9.389, range=-10..10)
g_slider2 = Slider(-1.828, range=-10..10)
g_slider1 = Slider(2.078, range=-10..10)
g_slider0 = Slider(-3.73, range=-10..10)
pi = Pi(Factor=number_slider_3)
line = LineSDL(Start=pt, Direction=Vector(0, 0, 1), Length=number_slider)
embryo = EmbryoSettings(Preview=False, SliderDomain=Domain(-10, 10), OneToOne=True, GridX=160, GridY=120, RemoveDead=True, OnlyTerminals=False)
pframes = PerpFrames(Curve=line, Count=number_slider_2, Align=True)  # -> Frames, Parameters
multiplication = Multiplication(A=pframes.Parameters, B=pi)
rotate = Rotate(Geometry=pframes.Frames, Angle=multiplication, Plane=PlaneXY(0, 0, 0))  # -> Geometry, Transform
pln = Plane(rotate.Geometry)
embryo_2 = Embryo(
    Reset=Toggle(True),
    Sliders=Slider(6, range=0..10),
    Components=Slider(6, range=0..100),
    MetricGenes=2,
    TopologyGenes=2,
    FunctionGenes=2,
    Settings=embryo,
    RandomOveride=Slider(539, range=0..1000))  # -> Iterations, Components
g_box = CenterBox(Base=PlaneXY(0, 0, 0), X=1, Y=1, Z=1)
g_box_2 = CenterBox(Base=PlaneXY(0, 0, 0), X=g_slider0, Y=g_slider1, Z=g_slider5)
g_box_3 = CenterBox(Base=pln, X=g_slider4, Y=g_slider2, Z=g_slider3)
embryo_output = EmbryoOutput(O=pln)
g_debrep = DeconstructBrep(Brep=g_box)  # -> Faces, Edges, Vertices
g_box_4 = CenterBox(Base=g_debrep.Vertices, X=1, Y=1, Z=1)
g_debrep_2 = DeconstructBrep(Brep=g_box_4)  # -> Faces, Edges, Vertices
parent_input = ParentInput()
parent_input_2 = ParentInput()
brep = Brep(flatten([parent_input, g_box_3]))
brep_2 = Brep(flatten([parent_input_2, g_debrep.Faces]))
bbox = BoundingBox(Content=brep, Plane=PlaneXY(0, 0, 0), UnionBox=True)  # -> Box, Box_2
debox = DeconstructBox(Box=bbox.Box)  # -> Plane, X, Y, Z
preview = CustomPreview(Geometry=brep_2, Shader=ColourSwatch(SwatchColor=RGB(0, 0, 0)))
preview_2 = CustomPreview(Geometry=brep, Shader=ColourSwatch(SwatchColor=RGB(255, 255, 255)))
dedomain = DeconstructDomain(Domain=debox.Y)  # -> Start, End
cyl = Cylinder(Base=PlaneXY(0, 0, 0), Radius=expr("x*0.8", dedomain.Start), Length=number_slider)
cap = CapHoles(Brep=cyl)
preview_3 = CustomPreview(
    Geometry=cap,
    Shader={diffuse=RGB(255, 105, 180), emission=RGB(76, 32, 54), shine=0.5, specular=RGB(255, 255, 255), transparency=0})
