# Grasshopper definition E01_0.2.0_SimplePoint&Box.gh (Grasshopper 0.9.75)
# plug-ins: Embryo

# The component types that are used are placed here. More of the same type increases the likelyhood of selection (such as with the points here).
# You can enable/disable to include/exclude in your graph generation
pt = ConstructPoint(XCoordinate=0, YCoordinate=0, ZCoordinate=0)
box = Box2Pt(Plane=PlaneXY(0, 0, 0))
pt_2 = ConstructPoint(XCoordinate=0, YCoordinate=0, ZCoordinate=0)

# ----
# Set to True
toggle = BooleanToggle(True)

# ----
# Sliders & Component numbers
sliders = Slider(6, range=0..100)
components = Slider(35, range=0..100)

# ----
# Change Random Seed to Explore
random_seed = Slider(28, range=0..100)

# ----
# E01. Introduction
# 
# Embryo uses 3 of the 4 quadrants on the canvas.
# 
# The 'Parent' definition is located in the usual quadrant on the canvas and contains the Embryo main component.
# 
# The 'Child' generated network is in the top-right quadrant.
# The 'Ingredients' that are used (the components) by Embryo when the new graph is formed are located in the bottom-left quadrant.
g_slider5 = Slider(0.339, range=-10..10)
g_slider4 = Slider(7.626, range=-10..10)
g_slider3 = Slider(1.975, range=-10..10)
g_slider2 = Slider(-0.968, range=-10..10)
g_slider1 = Slider(0.691, range=-10..10)
g_slider0 = Slider(-2.917, range=-10..10)
# This is the main Embryo component that generates the new definitions.
# 
# Embryo has two separate (at present random) seeds for generating the parameters and the graph components/topology. In this example they are both controlled by one slider
embryo = Embryo(
    Reset=toggle,
    Sliders=sliders,
    Components=components,
    MetricGenes=2,
    TopologyGenes=2,
    FunctionGenes=2,
    Settings=null,
    RandomOveride=random_seed)  # -> Iterations, Components
g_pt = ConstructPoint(XCoordinate=g_slider2, YCoordinate=g_slider1, ZCoordinate=g_slider4)
g_pt_2 = ConstructPoint(XCoordinate=g_slider1, YCoordinate=g_slider4, ZCoordinate=g_slider2)
g_pt_3 = ConstructPoint(XCoordinate=g_slider4, YCoordinate=g_slider3, ZCoordinate=g_slider5)
g_pt_4 = ConstructPoint(XCoordinate=g_slider4, YCoordinate=g_slider5, ZCoordinate=g_slider3)
g_pt_5 = ConstructPoint(XCoordinate=g_slider2, YCoordinate=g_slider1, ZCoordinate=g_slider3)
g_pt_6 = ConstructPoint(XCoordinate=g_slider2, YCoordinate=g_slider4, ZCoordinate=g_slider5)
g_pt_7 = ConstructPoint(XCoordinate=g_slider4, YCoordinate=g_slider2, ZCoordinate=g_slider5)
g_pt_8 = ConstructPoint(XCoordinate=g_slider1, YCoordinate=g_slider4, ZCoordinate=g_slider0)
g_pt_9 = ConstructPoint(XCoordinate=g_slider1, YCoordinate=g_slider5, ZCoordinate=g_slider3)
g_pt_10 = ConstructPoint(XCoordinate=g_slider4, YCoordinate=g_slider1, ZCoordinate=g_slider3)
g_pt_11 = ConstructPoint(XCoordinate=g_slider4, YCoordinate=g_slider5, ZCoordinate=g_slider0)
g_pt_12 = ConstructPoint(XCoordinate=g_slider2, YCoordinate=g_slider3, ZCoordinate=g_slider5)
g_pt_13 = ConstructPoint(XCoordinate=g_slider5, YCoordinate=g_slider2, ZCoordinate=g_slider0)
g_pt_14 = ConstructPoint(XCoordinate=g_slider3, YCoordinate=g_slider0, ZCoordinate=g_slider2)
g_pt_15 = ConstructPoint(XCoordinate=g_slider5, YCoordinate=g_slider0, ZCoordinate=g_slider3)
g_pt_16 = ConstructPoint(XCoordinate=g_slider3, YCoordinate=g_slider5, ZCoordinate=g_slider4)
g_pt_17 = ConstructPoint(XCoordinate=g_slider2, YCoordinate=g_slider5, ZCoordinate=g_slider0)
g_pt_18 = ConstructPoint(XCoordinate=g_slider3, YCoordinate=g_slider1, ZCoordinate=g_slider0)
g_pt_19 = ConstructPoint(XCoordinate=g_slider3, YCoordinate=g_slider1, ZCoordinate=g_slider2)
g_pt_20 = ConstructPoint(XCoordinate=g_slider1, YCoordinate=g_slider4, ZCoordinate=g_slider0)
g_pt_21 = ConstructPoint(XCoordinate=g_slider3, YCoordinate=g_slider5, ZCoordinate=g_slider4)
g_pt_22 = ConstructPoint(XCoordinate=g_slider1, YCoordinate=g_slider2, ZCoordinate=g_slider0)
g_pt_23 = ConstructPoint(XCoordinate=g_slider2, YCoordinate=g_slider3, ZCoordinate=g_slider5)
g_pt_24 = ConstructPoint(XCoordinate=g_slider5, YCoordinate=g_slider2, ZCoordinate=g_slider0)
g_box = Box2Pt(Plane=PlaneXY(0, 0, 0))
g_box_2 = Box2Pt(PointA=g_pt_8, PointB=g_pt_10, Plane=PlaneXY(0, 0, 0))
g_box_3 = Box2Pt(PointA=g_pt_7, PointB=g_pt_9, Plane=PlaneXY(0, 0, 0))
g_box_4 = Box2Pt(PointA=g_pt_23, PointB=g_pt_13, Plane=PlaneXY(0, 0, 0))
g_box_5 = Box2Pt(PointA=g_pt_11, PointB=g_pt_23, Plane=PlaneXY(0, 0, 0))
g_box_6 = Box2Pt(PointA=g_pt_13, PointB=g_pt_17, Plane=PlaneXY(0, 0, 0))
g_box_7 = Box2Pt(PointA=g_pt_20, PointB=g_pt_16, Plane=PlaneXY(0, 0, 0))
g_box_8 = Box2Pt(PointA=g_pt_23, PointB=g_pt_17, Plane=PlaneXY(0, 0, 0))
g_box_9 = Box2Pt(PointA=g_pt_20, PointB=g_pt_22, Plane=PlaneXY(0, 0, 0))
# The generated graph is sorted in terms of dependency.
# 
# The parameters always have rank 0 and therefore are located on the far left hand side.
# 
# In a technical sense, the directed acyclic graph (DAG) that is generated is topologically sorted to show a dependency structure.
g_box_10 = Box2Pt(PointA=g_pt_24, PointB=g_pt_23, Plane=PlaneXY(0, 0, 0))
g_box_11 = Box2Pt(PointA=g_pt_24, PointB=g_pt_21, Plane=PlaneXY(0, 0, 0))
