# Grasshopper definition E02_0.2.0_PointsLinesDivide.gh (Grasshopper 0.9.76)
# plug-ins: Embryo

# E02.
# 
# In this example the form generated is slightly more complex than E01 due to the inclusion of a divide component.
# 
# The settings component is also introduced.
divide = DivideCurve(Count=10, Kinks=False)  # -> Points, Tangents, Parameters
box = Box2Pt(Plane=PlaneXY(0, 0, 0))
pt = ConstructPoint(XCoordinate=0, YCoordinate=0, ZCoordinate=0)
ln = Line()
number_slider = Slider(37, range=0..100)
g_slider36 = Slider(-6.84, range=-10..10)
g_slider35 = Slider(4.367, range=-10..10)
g_slider34 = Slider(1.925, range=-10..10)
g_slider33 = Slider(7.926, range=-10..10)
g_slider32 = Slider(0.753, range=-10..10)
g_slider31 = Slider(-1.344, range=-10..10)
g_slider30 = Slider(-6.377, range=-10..10)
g_slider29 = Slider(7.908, range=-10..10)
g_slider28 = Slider(2.057, range=-10..10)
g_slider27 = Slider(-1.843, range=-10..10)
g_slider26 = Slider(10, range=-10..10)
g_slider25 = Slider(5.229, range=-10..10)
g_slider24 = Slider(0.265, range=-10..10)
g_slider23 = Slider(6.804, range=-10..10)
g_slider22 = Slider(-6.13, range=-10..10)
g_slider21 = Slider(-0.004, range=-10..10)
g_slider20 = Slider(2.566, range=-10..10)
g_slider19 = Slider(1.2, range=-10..10)
g_slider18 = Slider(-1.776, range=-10..10)
g_slider17 = Slider(4.369, range=-10..10)
g_slider16 = Slider(-8.338, range=-10..10)
g_slider15 = Slider(-3.596, range=-10..10)
g_slider14 = Slider(5.92, range=-10..10)
g_slider13 = Slider(-4.571, range=-10..10)
g_slider12 = Slider(6.864, range=-10..10)
g_slider11 = Slider(-1.189, range=-10..10)
g_slider10 = Slider(10, range=-10..10)
g_slider9 = Slider(6.001, range=-10..10)
g_slider8 = Slider(10, range=-10..10)
g_slider7 = Slider(4.742, range=-10..10)
g_slider6 = Slider(1.984, range=-10..10)
g_slider5 = Slider(-2.573, range=-10..10)
g_slider4 = Slider(-1.166, range=-10..10)
g_slider3 = Slider(-0.899, range=-10..10)
g_slider2 = Slider(4.361, range=-10..10)
g_slider1 = Slider(4.013, range=-10..10)
g_slider0 = Slider(6.369, range=-10..10)

# ----
# Setting RemoveDead to True will remove any components that have either a warning or error flag (note: this is just a visibility toggle, such compoents will never be connected to once they are not clean).
# The settings component contains extra user preferences such as whether a preview is displayed, the parameter domains, grid size, etc...
toggle = BooleanToggle(True)
embryo = EmbryoSettings(Preview=True, SliderDomain=Domain(-10, 10), OneToOne=False, GridX=120, GridY=120, RemoveDead=toggle, OnlyTerminals=False)

embryo_2 = Embryo(
    Reset=Toggle(False),
    Sliders=number_slider,
    Components=number_slider,
    MetricGenes=2,
    TopologyGenes=2,
    FunctionGenes=2,
    Settings=embryo,
    RandomOveride=Slider(71, range=0..100))  # -> Iterations, Components
g_pt = ConstructPoint(XCoordinate=g_slider19, YCoordinate=g_slider18, ZCoordinate=g_slider16)
g_pt_2 = ConstructPoint(XCoordinate=g_slider18, YCoordinate=g_slider31, ZCoordinate=g_slider29)
g_pt_3 = ConstructPoint(XCoordinate=g_slider10, YCoordinate=g_slider9, ZCoordinate=g_slider22)
g_pt_4 = ConstructPoint(XCoordinate=g_slider10, YCoordinate=g_slider17, ZCoordinate=g_slider11)
g_pt_5 = ConstructPoint(XCoordinate=g_slider8, YCoordinate=g_slider4, ZCoordinate=g_slider32)
g_pt_6 = ConstructPoint(XCoordinate=g_slider1, YCoordinate=g_slider22, ZCoordinate=g_slider35)
g_pt_7 = ConstructPoint(XCoordinate=g_slider2, YCoordinate=g_slider1, ZCoordinate=g_slider25)
g_pt_8 = ConstructPoint(XCoordinate=g_slider24, YCoordinate=g_slider26, ZCoordinate=g_slider16)
g_pt_9 = ConstructPoint(XCoordinate=g_slider26, YCoordinate=g_slider10, ZCoordinate=g_slider8)
g_box = Box2Pt(PointA=g_pt_9, PointB=g_pt_2, Plane=PlaneXY(0, 0, 0))
g_box_2 = Box2Pt(PointA=g_pt_5, PointB=g_pt_7, Plane=PlaneXY(0, 0, 0))
g_ln = Line(StartPoint=g_pt_6, EndPoint=g_pt_7)
g_ln_2 = Line(StartPoint=g_pt_7, EndPoint=g_pt_8)
g_box_3 = Box2Pt(PointA=g_pt_6, PointB=g_pt_8, Plane=PlaneXY(0, 0, 0))
g_ln_3 = Line(StartPoint=g_pt_6, EndPoint=g_pt_7)
g_ln_4 = Line(StartPoint=g_pt_7, EndPoint=g_pt_9)
g_box_4 = Box2Pt(PointA=g_pt_9, PointB=g_pt_6, Plane=PlaneXY(0, 0, 0))
g_ln_5 = Line(StartPoint=g_pt_8, EndPoint=g_pt_7)
g_box_5 = Box2Pt(PointA=g_pt_9, PointB=g_pt_7, Plane=PlaneXY(0, 0, 0))
g_divide = DivideCurve(Curve=g_ln_2, Count=g_slider14, Kinks=False)  # -> Points, Tangents, Parameters
g_divide_2 = DivideCurve(Curve=g_ln_4, Count=g_slider4, Kinks=False)  # -> Points, Tangents, Parameters
g_divide_3 = DivideCurve(Curve=g_ln_5, Count=g_slider5, Kinks=False)  # -> Points, Tangents, Parameters
g_divide_4 = DivideCurve(Curve=g_ln_5, Count=g_slider22, Kinks=False)  # -> Points, Tangents, Parameters
g_divide_5 = DivideCurve(Curve=g_ln_5, Count=g_slider32, Kinks=False)  # -> Points, Tangents, Parameters
g_divide_6 = DivideCurve(Curve=g_ln_5, Count=g_slider10, Kinks=False)  # -> Points, Tangents, Parameters
g_divide_7 = DivideCurve(Curve=g_ln_4, Count=g_divide.Parameters, Kinks=False)  # -> Points, Tangents, Parameters
g_box_6 = Box2Pt(PointA=g_divide_3.Points, PointB=g_pt_7, Plane=PlaneXY(0, 0, 0))
g_box_7 = Box2Pt(PointA=g_divide_6.Points, PointB=g_pt_4, Plane=PlaneXY(0, 0, 0))
g_ln_6 = Line(StartPoint=g_divide_6.Points, EndPoint=g_pt_6)
g_divide_8 = DivideCurve(Curve=g_ln_6, Count=g_slider26, Kinks=False)  # -> Points, Tangents, Parameters
g_divide_9 = DivideCurve(Curve=g_ln_6, Count=g_slider7, Kinks=False)  # -> Points, Tangents, Parameters
g_ln_7 = Line(StartPoint=g_divide_7.Points, EndPoint=g_pt_9)
