# Grasshopper definition E03_0.2.0_UsingParentOutputs&Inputs.gh (Grasshopper 0.9.56)
# plug-ins: Embryo

# E03.
# 
# In this example, we look at how a new definition can interact with an existing one. To do so, we tag outputs from the parent canvas that are then included when the graph begins to form.
# 
# We can also tag inputs so that they hook up to elements in the generated definition.
# 
# This shows how existing generative models can be included in an Embryo process.
pt = PointXYZ(XComponent=0, YComponent=0, ZComponent=0, System=PlaneXY(0, 0, 0))
pt_2 = PointXYZ(XComponent=0, YComponent=0, ZComponent=0, System=PlaneXY(0, 0, 0))
rotate = Rotate(Angle=1.570796327, Plane=PlaneXY(0, 0, 0))  # -> Geometry, Transform
box = Box2Pt(Plane=PlaneXY(0, 0, 0))
pt_3 = ConstructPoint(XCoordinate=0, YCoordinate=0, ZCoordinate=10)

# ----
# By setting the Embryo reset toggle to false (below) and adjusting this parameter, you can see how the generated form can still be controlled by an existing parent definition.
twist = Slider(1.36, range=0..3.141)

pt_4 = ConstructPoint(XCoordinate=0, YCoordinate=0, ZCoordinate=0)
components = Slider(25, range=0..100)

# ----
# Setting the seeds to zero negates them and hence Embryo generates something different each time it is computed.
# 
# (Erdős–Rényi DAG)
random_seed = Slider(0, range=0..100)

# ----
# Set to True
toggle = BooleanToggle(False)

g_slider7 = Slider(-1.156, range=-10..10)
g_slider6 = Slider(8.121, range=-10..10)
g_slider5 = Slider(1.178, range=-10..10)
g_slider4 = Slider(-5.879, range=-10..10)
g_slider3 = Slider(1.163, range=-10..10)
g_slider2 = Slider(5.36, range=-10..10)
g_slider1 = Slider(6.347, range=-10..10)
g_slider0 = Slider(4.525, range=-10..10)
ln = Line(StartPoint=pt_4, EndPoint=pt_3)
pframes = PerpFrames(Curve=ln, Count=3, Align=True)  # -> Frames, Parameters
multiplication = Multiplication(A=pframes.Parameters, B=twist)
embryo = Embryo(Reset=toggle, Sliders=8, Components=components, MetricSeed=random_seed, TopologySeed=random_seed, Settings=null)  # -> Iterations, Components
prot = RotatePlane(Plane=pframes.Frames, Angle=multiplication)

parent_output = ParentOutput(O=prot)
panel = Panel("Parent output tag")

# ----
# The Cognise components can be used to step through a network, either component by component or column by column after a topological sort.
colstep = ColumnStep(Components=embryo.Components, LastColumn=Slider(10, range=0..10))

comstep = ComponentStep(LastComponent=0)
g_pt = ConstructPoint(XCoordinate=g_slider5, YCoordinate=g_slider6, ZCoordinate=g_slider0, System=prot)
g_pt_2 = ConstructPoint(XCoordinate=g_slider4, YCoordinate=g_slider7, ZCoordinate=g_slider3, System=prot)
g_pt_3 = ConstructPoint(XCoordinate=g_slider6, YCoordinate=g_slider4, ZCoordinate=g_slider5, System=prot)
pt_5 = PointXYZ(XComponent=g_slider1, YComponent=g_slider0, ZComponent=g_slider3, System=prot)
g_pt_4 = ConstructPoint(XCoordinate=g_slider6, YCoordinate=g_slider5, ZCoordinate=g_slider3, System=prot)
pt_6 = PointXYZ(XComponent=g_slider0, YComponent=g_slider3, ZComponent=g_slider1, System=prot)
g_pt_5 = ConstructPoint(XCoordinate=g_slider3, YCoordinate=g_slider7, ZCoordinate=g_slider5, System=prot)
g_pt_6 = ConstructPoint(XCoordinate=g_slider7, YCoordinate=g_slider4, ZCoordinate=g_slider6, System=prot)
g_pt_7 = ConstructPoint(XCoordinate=g_slider7, YCoordinate=g_slider2, ZCoordinate=g_slider5, System=prot)
g_pt_8 = ConstructPoint(XCoordinate=g_slider7, YCoordinate=g_slider6, ZCoordinate=g_slider4, System=prot)
g_pt_9 = ConstructPoint(XCoordinate=g_slider4, YCoordinate=g_slider1, ZCoordinate=g_slider6, System=prot)
g_rotate = Rotate(Angle=g_slider6, Plane=prot)  # -> Geometry, Transform
pt_7 = PointXYZ(XComponent=g_slider6, YComponent=g_slider2, ZComponent=g_slider0, System=prot)
g_box = Box2Pt(Plane=prot)
g_box_2 = Box2Pt(PointA=g_pt_6, PointB=g_pt_3, Plane=prot)
g_box_3 = Box2Pt(PointA=g_pt_8, PointB=g_pt_5, Plane=prot)
g_box_4 = Box2Pt(PointA=g_pt_7, PointB=g_pt_6, Plane=prot)
g_rotate_2 = Rotate(Geometry=g_rotate.Geometry, Angle=g_slider4, Plane=prot)  # -> Geometry, Transform
g_rotate_3 = Rotate(Geometry=g_rotate.Geometry, Angle=g_slider5, Plane=prot)  # -> Geometry, Transform
g_box_5 = Box2Pt(PointA=g_pt_6, PointB=pt_7, Plane=prot)
g_rotate_4 = Rotate(Geometry=g_rotate.Geometry, Angle=g_slider7, Plane=prot)  # -> Geometry, Transform
g_rotate_5 = Rotate(Geometry=g_rotate.Geometry, Angle=g_slider1, Plane=prot)  # -> Geometry, Transform
g_box_6 = Box2Pt(PointA=pt_7, Plane=prot)
g_rotate_6 = Rotate(Geometry=g_rotate_3.Geometry, Angle=g_slider4, Plane=prot)  # -> Geometry, Transform
g_rotate_7 = Rotate(Geometry=g_box_5, Angle=g_slider2, Plane=prot)  # -> Geometry, Transform
g_rotate_8 = Rotate(Geometry=g_rotate_2.Geometry, Angle=g_slider3, Plane=prot)  # -> Geometry, Transform
g_rotate_9 = Rotate(Geometry=g_box_5, Angle=g_slider4, Plane=prot)  # -> Geometry, Transform
g_rotate_10 = Rotate(Geometry=g_rotate_7.Geometry, Angle=g_slider0, Plane=prot)  # -> Geometry, Transform

# ----
# A parent input can get data (in this case number parameters) and use them in a standard definition.
# 
# Here we see how the generated loft is connected to the generated sliders.
parent_input = ParentInput()
num = Number([parent_input, g_slider6])
num_2 = Number([parent_input, g_slider0])
rectangle = Rectangle(Plane=prot, XSize=num, YSize=num_2, Radius=0)  # -> Rectangle, Length
loft = Loft(
    Curves=rectangle.Rectangle,
    Options={Adjust=False, Closed=False, Rebuild=10, Refit=0.01, LoftType=0, LoftEnds=0, LoftSimp=0})
