# Grasshopper definition E04_0.2.0_UsingParentSliders.gh (Grasshopper 0.9.56)
# plug-ins: Embryo

pt = ConstructPoint(XCoordinate=0, YCoordinate=0, ZCoordinate=0)
# E04.
# 
# Existing sliders/parameters can be inlcuded by tagging them with parent outputs.
# 
# Once a design is generated, try tweaking the sliders to see what variation the generated generative model can produce.
ln = Line()
pt_2 = ConstructPoint(XCoordinate=0, YCoordinate=0, ZCoordinate=0)
ln_2 = Line()
box = Box2Pt(Plane=PlaneXY(0, 0, 0))
box_2 = Box2Pt(Plane=PlaneXY(0, 0, 0))
divide = DivideCurve(Count=10, Kinks=False)  # -> Points, Tangents, Parameters
box_3 = Box2Pt(Plane=PlaneXY(0, 0, 0))
divide_2 = DivideCurve(Count=10, Kinks=False)  # -> Points, Tangents, Parameters
box_4 = Box2Pt(Plane=PlaneXY(0, 0, 0))
divide_3 = DivideCurve(Count=10, Kinks=False)  # -> Points, Tangents, Parameters
divide_4 = DivideCurve(Count=10, Kinks=False)  # -> Points, Tangents, Parameters

# ----
# Existing Sliders
slider = Slider(0, range=0..100)

# ----
# Set to True
toggle = BooleanToggle(False)

sliders = Slider(0, range=0..100)
components = Slider(41, range=0..100)

# ----
# Change Random Seed to Explore
number_slider = Slider(951, range=0..10000)

# ----
# Existing Sliders can be used by attaching to a 'parent output' component.
parent_output = ParentOutput(O=[Slider(38, range=0..100), slider, Slider(38, range=0..100), Slider(47, range=0..100), Slider(73, range=0..100), Slider(1, range=0..100), Slider(7, range=0..100)])

embryo = Embryo(
    Reset=toggle,
    Sliders=sliders,
    Components=components,
    MetricSeed=number_slider,
    TopologySeed=number_slider,
    Settings=null)  # -> Iterations, Components

# ----
# The Cognise components can be used to step through a network, either component by component or column by column after a topological sort.
colstep = ColumnStep(Components=embryo.Components, LastColumn=Slider(5, range=0..10))

comstep = ComponentStep(LastComponent=0)
