# Grasshopper definition E05_0.2.0_IncludingExistingComponents.gh (Grasshopper 0.9.56)
# plug-ins: Embryo

dom = ConstructDomain(DomainStart=0, DomainEnd=16)
number_slider = Slider(120, range=0..1000)

# ----
# Generated new components set to zero.
number_slider_2 = Slider(0, range=0..100)

# ----
# E05.
# 
# Ingredient components do not have to be used. If we have a specific number of components that we wish to use then these can be placed directly in the child area.
# 
# Upon execution, Embryo will then include these when generating the graph.
# 
# If the new component number is set to zero, these existing components will be the ONLY ones used when forming graphs. Note they will have a prefix 'E' as part of the component message.
pt = ConstructPoint(XCoordinate=0, YCoordinate=0, ZCoordinate=0)
pt_2 = ConstructPoint(XCoordinate=0, YCoordinate=0, ZCoordinate=0)
box = Box2Pt(Plane=PlaneXY(0, 0, 0))
shear = Shear(Base=PlaneXY(0, 0, 0), Grip=Point(0, 0, 1), Target=Point(0, 0, 1))  # -> Geometry, Transform
embryo = EmbryoSettings(Preview=True, SliderDomain=dom, OneToOne=False, GridX=number_slider, GridY=number_slider, RemoveDead=Toggle(True))
rotate = Rotate(Angle=1.570796327, Plane=PlaneXY(0, 0, 0))  # -> Geometry, Transform
pt_3 = ConstructPoint(XCoordinate=0, YCoordinate=0, ZCoordinate=0)
box_2 = Box2Pt(Plane=PlaneXY(0, 0, 0))
embryo_2 = Embryo(
    Reset=Toggle(False),
    Sliders=8,
    Components=number_slider_2,
    MetricSeed=2,
    TopologySeed=Slider(38, range=0..100),
    Settings=embryo)  # -> Iterations, Components
shear_2 = Shear(Base=PlaneXY(0, 0, 0), Grip=Point(0, 0, 1), Target=Point(0, 0, 1))  # -> Geometry, Transform
rotate_2 = Rotate(Angle=1.570796327, Plane=PlaneXY(0, 0, 0))  # -> Geometry, Transform
rotate_3 = Rotate(Angle=1.570796327, Plane=PlaneXY(0, 0, 0))  # -> Geometry, Transform
shear_3 = Shear(Base=PlaneXY(0, 0, 0), Grip=Point(0, 0, 1), Target=Point(0, 0, 1))  # -> Geometry, Transform
pt_4 = ConstructPoint(XCoordinate=0, YCoordinate=0, ZCoordinate=0)
pt_5 = ConstructPoint(XCoordinate=0, YCoordinate=0, ZCoordinate=0)
rotate_4 = Rotate(Angle=1.570796327, Plane=PlaneXY(0, 0, 0))  # -> Geometry, Transform
box_3 = Box2Pt(Plane=PlaneXY(0, 0, 0))
shear_4 = Shear(Base=PlaneXY(0, 0, 0), Grip=Point(0, 0, 1), Target=Point(0, 0, 1))  # -> Geometry, Transform
pt_6 = ConstructPoint(XCoordinate=0, YCoordinate=0, ZCoordinate=0)
box_4 = Box2Pt(Plane=PlaneXY(0, 0, 0))
rotate_5 = Rotate(Angle=1.570796327, Plane=PlaneXY(0, 0, 0))  # -> Geometry, Transform
rotate_6 = Rotate(Angle=1.570796327, Plane=PlaneXY(0, 0, 0))  # -> Geometry, Transform
shear_5 = Shear(Base=PlaneXY(0, 0, 0), Grip=Point(0, 0, 1), Target=Point(0, 0, 1))  # -> Geometry, Transform
shear_6 = Shear(Base=PlaneXY(0, 0, 0), Grip=Point(0, 0, 1), Target=Point(0, 0, 1))  # -> Geometry, Transform
