# Grasshopper definition E06_0.2.0_WithTimer(LibeskindEYHO).gh (Grasshopper 0.9.56)
# plug-ins: Embryo

# E06.
# 
# Using a timer can give you a broad idea of what your ingredient components are capable of generating.
# 
# Also try disabling the timer and then play with the sliders.
pt = ConstructPoint(XCoordinate=0, YCoordinate=0, ZCoordinate=0)
pt_2 = ConstructPoint(XCoordinate=0, YCoordinate=0, ZCoordinate=0)
pl_3pt = Plane3Pt()
box = Box2Pt(Plane=PlaneXY(0, 0, 0))
toggle = BooleanToggle(False)
g_slider9 = Slider(-2.656, range=-10..10)
g_slider8 = Slider(6.178, range=-10..10)
g_slider7 = Slider(-8.087, range=-10..10)
g_slider6 = Slider(8.357, range=-10..10)
g_slider5 = Slider(5.707, range=-10..10)
g_slider4 = Slider(1.373, range=-10..10)
g_slider3 = Slider(7.805, range=-10..10)
g_slider2 = Slider(-7.409, range=-10..10)
g_slider1 = Slider(6.089, range=-10..10)
g_slider0 = Slider(-7.208, range=-10..10)
not = GateNot(A=toggle)
timer = Timer(TimerInterval=1000, Target=counter)
counter = Counter(Reset=not)

# ----
# Note that because the metric seed is set constant, the generated sliders stay the same even when the topology changes as the counter increments.
embryo = Embryo(
    Reset=toggle,
    Sliders=Slider(10, range=0..10),
    Components=Slider(45, range=0..100),
    MetricSeed=Slider(33931, range=0..100000),
    TopologySeed=counter,
    Settings=null)  # -> Iterations, Components

g_pt = ConstructPoint(XCoordinate=g_slider7, YCoordinate=g_slider8, ZCoordinate=g_slider6)
g_pt_2 = ConstructPoint(XCoordinate=g_slider6, YCoordinate=g_slider2, ZCoordinate=g_slider9)
g_pt_3 = ConstructPoint(XCoordinate=g_slider2, YCoordinate=g_slider0, ZCoordinate=g_slider7)
g_pt_4 = ConstructPoint(XCoordinate=g_slider1, YCoordinate=g_slider9, ZCoordinate=g_slider2)
g_pt_5 = ConstructPoint(XCoordinate=g_slider3, YCoordinate=g_slider5, ZCoordinate=g_slider0)
g_pt_6 = ConstructPoint(XCoordinate=g_slider3, YCoordinate=g_slider5, ZCoordinate=g_slider4)
g_pt_7 = ConstructPoint(XCoordinate=g_slider8, YCoordinate=g_slider2, ZCoordinate=g_slider5)
g_pt_8 = ConstructPoint(XCoordinate=g_slider0, YCoordinate=g_slider6, ZCoordinate=g_slider8)
g_pt_9 = ConstructPoint(XCoordinate=g_slider1, YCoordinate=g_slider3, ZCoordinate=g_slider4)
g_pt_10 = ConstructPoint(XCoordinate=g_slider5, YCoordinate=g_slider1, ZCoordinate=g_slider6)
g_pt_11 = ConstructPoint(XCoordinate=g_slider9, YCoordinate=g_slider4, ZCoordinate=g_slider3)
g_pt_12 = ConstructPoint(XCoordinate=g_slider9, YCoordinate=g_slider3, ZCoordinate=g_slider5)
g_pt_13 = ConstructPoint(XCoordinate=g_slider8, YCoordinate=g_slider9, ZCoordinate=g_slider2)
g_pt_14 = ConstructPoint(XCoordinate=g_slider0, YCoordinate=g_slider5, ZCoordinate=g_slider2)
g_pt_15 = ConstructPoint(XCoordinate=g_slider9, YCoordinate=g_slider6, ZCoordinate=g_slider5)
g_pt_16 = ConstructPoint(XCoordinate=g_slider4, YCoordinate=g_slider0, ZCoordinate=g_slider7)
g_pt_17 = ConstructPoint(XCoordinate=g_slider1, YCoordinate=g_slider7, ZCoordinate=g_slider0)
g_pt_18 = ConstructPoint(XCoordinate=g_slider0, YCoordinate=g_slider6, ZCoordinate=g_slider3)
g_pt_19 = ConstructPoint(XCoordinate=g_slider4, YCoordinate=g_slider3, ZCoordinate=g_slider2)
g_pt_20 = ConstructPoint(XCoordinate=g_slider8, YCoordinate=g_slider0, ZCoordinate=g_slider2)
g_pt_21 = ConstructPoint(XCoordinate=g_slider8, YCoordinate=g_slider4, ZCoordinate=g_slider1)
g_pt_22 = ConstructPoint(XCoordinate=g_slider8, YCoordinate=g_slider2, ZCoordinate=g_slider6)
g_pt_23 = ConstructPoint(XCoordinate=g_slider9, YCoordinate=g_slider3, ZCoordinate=g_slider8)
g_pt_24 = ConstructPoint(XCoordinate=g_slider5, YCoordinate=g_slider3, ZCoordinate=g_slider7)
g_pl_3pt = Plane3Pt(PointA=g_pt_10, PointB=g_pt_21, PointC=g_pt_8)
g_pl_3pt_2 = Plane3Pt(PointA=g_pt_10, PointB=g_pt_19, PointC=g_pt_11)
g_pl_3pt_3 = Plane3Pt(PointA=g_pt_5, PointB=g_pt_3, PointC=g_pt_10)
g_pl_3pt_4 = Plane3Pt(PointA=g_pt_10, PointB=g_pt_20, PointC=g_pt_15)
g_pl_3pt_5 = Plane3Pt(PointA=g_pt_13, PointB=g_pt_18, PointC=g_pt_10)
g_pl_3pt_6 = Plane3Pt(PointA=g_pt_24, PointB=g_pt_11, PointC=g_pt_13)
g_pl_3pt_7 = Plane3Pt(PointA=g_pt_11, PointB=g_pt_21, PointC=g_pt_14)
g_pl_3pt_8 = Plane3Pt(PointA=g_pt_24, PointB=g_pt_20, PointC=g_pt_15)
g_pl_3pt_9 = Plane3Pt(PointA=g_pt_19, PointB=g_pt_21, PointC=g_pt_20)
g_pl_3pt_10 = Plane3Pt(PointA=g_pt_24, PointB=g_pt_16, PointC=g_pt_17)
g_pl_3pt_11 = Plane3Pt(PointA=g_pt_23, PointB=g_pt_21, PointC=g_pt_19)
g_pl_3pt_12 = Plane3Pt(PointA=g_pt_23, PointB=g_pt_24)
g_box = Box2Pt(PointA=g_pt_10, PointB=g_pt_16, Plane=g_pl_3pt_5)
g_box_2 = Box2Pt(PointA=g_pt_20, PointB=g_pt_10, Plane=g_pl_3pt_11)
g_box_3 = Box2Pt(PointA=g_pt_22, PointB=g_pt_15, Plane=g_pl_3pt_11)
g_box_4 = Box2Pt(PointA=g_pt_12, PointB=g_pt_20, Plane=g_pl_3pt_9)
g_box_5 = Box2Pt(PointA=g_pt_23, PointB=g_pt_19, Plane=g_pl_3pt_10)
g_box_6 = Box2Pt(PointA=g_pt_15, PointB=g_pt_14, Plane=g_pl_3pt_9)
g_box_7 = Box2Pt(PointA=g_pt_9, PointB=g_pt_18, Plane=g_pl_3pt_9)
g_box_8 = Box2Pt(PointA=g_pt_20, PointB=g_pt_17, Plane=g_pl_3pt_11)
g_box_9 = Box2Pt(PointA=g_pt_17, PointB=g_pt_20, Plane=g_pl_3pt_11)
