# Grasshopper definition E08_0.2.0_Points&LineWithGalapagos.gh (Grasshopper 0.9.56)
# plug-ins: Embryo

# E08.
# 
# Now we translate E07 to geometry.
# This is a very simple problem, that of finding a generated network that draws a line between two points with maximum length.
pt = ConstructPoint(XCoordinate=0, YCoordinate=0, ZCoordinate=0)
pt_2 = ConstructPoint(XCoordinate=0, YCoordinate=0, ZCoordinate=0)
number_slider = Slider(1566, range=0..10000)
number_slider_2 = Slider(1152, range=0..10000)
g_slider7 = Slider(-8.401, range=-10..10)
g_slider6 = Slider(1.256, range=-10..10)
g_slider5 = Slider(-8.343, range=-10..10)
g_slider4 = Slider(-5.346, range=-10..10)
g_slider3 = Slider(6.196, range=-10..10)
g_slider2 = Slider(-2.336, range=-10..10)
g_slider1 = Slider(-3.782, range=-10..10)
g_slider0 = Slider(6.886, range=-10..10)
embryo = Embryo(Reset=Toggle(True), Sliders=8, Components=16, MetricSeed=number_slider, TopologySeed=number_slider_2, Settings=null)  # -> Iterations, Components
parent_input = ParentInput()
g_pt = ConstructPoint(XCoordinate=g_slider5, YCoordinate=g_slider7, ZCoordinate=g_slider1)
g_pt_2 = ConstructPoint(XCoordinate=g_slider3, YCoordinate=g_slider1, ZCoordinate=g_slider4)
g_pt_3 = ConstructPoint(XCoordinate=g_slider6, YCoordinate=g_slider5, ZCoordinate=g_slider0)
g_pt_4 = ConstructPoint(XCoordinate=g_slider5, YCoordinate=g_slider2, ZCoordinate=g_slider6)
g_pt_5 = ConstructPoint(XCoordinate=g_slider0, YCoordinate=g_slider5, ZCoordinate=g_slider3)
g_pt_6 = ConstructPoint(XCoordinate=g_slider3, YCoordinate=g_slider0, ZCoordinate=g_slider2)
g_pt_7 = ConstructPoint(XCoordinate=g_slider0, YCoordinate=g_slider2, ZCoordinate=g_slider4)
g_pt_8 = ConstructPoint(XCoordinate=g_slider6, YCoordinate=g_slider3, ZCoordinate=g_slider0)
g_pt_9 = ConstructPoint(XCoordinate=g_slider0, YCoordinate=g_slider3, ZCoordinate=g_slider4)
g_pt_10 = ConstructPoint(XCoordinate=g_slider6, YCoordinate=g_slider4, ZCoordinate=g_slider5)
g_pt_11 = ConstructPoint(XCoordinate=g_slider0, YCoordinate=g_slider2, ZCoordinate=g_slider3)
g_pt_12 = ConstructPoint(XCoordinate=g_slider4, YCoordinate=g_slider0, ZCoordinate=g_slider6)
g_pt_13 = ConstructPoint(XCoordinate=g_slider0, YCoordinate=g_slider4, ZCoordinate=g_slider3)
g_pt_14 = ConstructPoint(XCoordinate=g_slider7, YCoordinate=g_slider1, ZCoordinate=g_slider6)
g_pt_15 = ConstructPoint(XCoordinate=g_slider4, YCoordinate=g_slider5, ZCoordinate=g_slider2)
g_pt_16 = ConstructPoint(XCoordinate=g_slider3, YCoordinate=g_slider1, ZCoordinate=g_slider7)
ln = Line(StartPoint=[parent_input, g_pt_16], EndPoint=[parent_input, g_pt])
len = Length(Curve=ln)

# ----
# Galapogas sits on the parent canvas.
# 
# Data must be transfered to the parent before being used as a fitness criteria. This is achieved using a parent input as shown here.
galapagos = Galapagos(fitness=len, gene=[number_slider_2, number_slider])
