# Grasshopper definition E11_0.2.0_SpiderCharts.gh (Grasshopper 0.9.14)
# plug-ins: Embryo

random = Random(Range=Domain(0, 1), Number=5, Seed=3)
panel = Panel("""Environmental Cost
Captial Cost
Structural Performance
Gross Internal Floor Area
Quality Ranking""")
random_2 = Random(Range=Domain(0, 1), Number=16, Seed=3)
# Spider Graph
spider = SpiderChart(Data=random_2)
spider_2 = SpiderChart(Data=random, Legend=panel)
random_3 = Random(Range=Domain(0, 5.67), Number=100, Seed=3)
random_4 = Random(Range=Domain(0, 3), Number=100, Seed=2)
int = Integer(7)
# Scatter Plot
scatter = ScatterPlot(X=random_3, Y=random_4, R=int)
