# Grasshopper definition ShapeAnalysis102 Complex.gh (Grasshopper 0.9.56)
# plug-ins: Embryo

divide = DivideCurve(Count=10, Kinks=False)  # -> Points, Tangents, Parameters
box = Box2Pt(Plane=PlaneXY(0, 0, 0))
pt = ConstructPoint(XCoordinate=0, YCoordinate=0, ZCoordinate=0)
ln = Line()  # disabled
pt_2 = ConstructPoint(XCoordinate=0, YCoordinate=0, ZCoordinate=0)
genes = GenePool(Minimum=0, Maximum=100, Decimals=0, Value=[0, 20, 1, 56, 66, 18, 57, 100, 99, 97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])
genes_2 = GenePool(Minimum=-10, Maximum=10, Decimals=2, Value=[-10, -5.89, -8.75, -0.06, 2.83, -8.19, -6.36, 7.8])
genes_3 = GenePool(
    Minimum=0,
    Maximum=6,
    Decimals=4,
    Value=[1.419, 3.3934, 1.2107, 0, 1.7545, 3.6528, 3.1656, 1.7026, 0.0595, 0.3395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])
g_slider7 = Slider(7.8, range=-10..10)
g_slider6 = Slider(-6.36, range=-10..10)
g_slider5 = Slider(-8.19, range=-10..10)
g_slider4 = Slider(2.83, range=-10..10)
g_slider3 = Slider(-0.06, range=-10..10)
g_slider2 = Slider(-8.75, range=-10..10)
g_slider1 = Slider(-5.89, range=-10..10)
g_slider0 = Slider(-10, range=-10..10)
embryo = EmbryoSettings(Preview=False, SliderDomain=Domain(-10, 10), OneToOne=False, GridX=160, GridY=120, RemoveDead=True, OnlyTerminals=False)
embryo_2 = Embryo(
    Reset=Toggle(False),
    Sliders=Slider(8, range=0..10),
    Components=Slider(18, range=0..100),
    MetricGenes=genes_2,
    TopologyGenes=genes,
    FunctionGenes=genes_3,
    Settings=embryo,
    RandomOveride=0)  # -> Iterations, Components
g_pt = ConstructPoint(XCoordinate=g_slider6, YCoordinate=g_slider3, ZCoordinate=g_slider1)
g_pt_2 = ConstructPoint(XCoordinate=g_slider6, YCoordinate=g_slider1, ZCoordinate=g_slider5)
g_pt_3 = ConstructPoint(XCoordinate=g_slider3, YCoordinate=g_slider2, ZCoordinate=g_slider1)
pt_3 = Point(Point(5.43599987, -1.542000055, -0.474999994))
pt_4 = Point(Point(5.43599987, 3.493999958, -6.252999783))
ln_2 = Line(StartPoint=pt_4, EndPoint=pt_3)
g_divide = DivideCurve(Curve=ln_2, Count=g_slider3, Kinks=False)  # -> Points, Tangents, Parameters
g_divide_2 = DivideCurve(Curve=ln_2, Count=g_slider7, Kinks=False)  # -> Points, Tangents, Parameters
g_divide_3 = DivideCurve(Curve=ln_2, Count=g_slider4, Kinks=False)  # -> Points, Tangents, Parameters
g_divide_4 = DivideCurve(Curve=ln_2, Count=g_divide_3.Parameters, Kinks=False)  # -> Points, Tangents, Parameters
g_pt_4 = ConstructPoint(XCoordinate=g_divide_2.Parameters, YCoordinate=g_divide_3.Parameters, ZCoordinate=g_slider2)
g_pt_5 = ConstructPoint(XCoordinate=g_slider6, YCoordinate=g_divide_3.Parameters, ZCoordinate=g_divide.Parameters)
g_pt_6 = ConstructPoint(XCoordinate=g_slider3, YCoordinate=g_slider0, ZCoordinate=g_divide_3.Parameters)
g_pt_7 = ConstructPoint(XCoordinate=g_slider0, YCoordinate=g_divide_3.Parameters, ZCoordinate=g_slider4)
g_pt_8 = ConstructPoint(XCoordinate=g_divide_3.Parameters, YCoordinate=g_slider0, ZCoordinate=g_slider4)
g_pt_9 = ConstructPoint(XCoordinate=g_slider0, YCoordinate=g_slider1, ZCoordinate=g_divide_3.Parameters)
g_box = Box2Pt(PointA=g_pt_2, PointB=g_divide_3.Points, Plane=PlaneXY(0, 0, 0))
g_pt_10 = ConstructPoint(XCoordinate=g_divide_2.Parameters, YCoordinate=g_slider0, ZCoordinate=g_slider1)
g_box_2 = Box2Pt(PointA=g_pt_3, PointB=g_divide_2.Points, Plane=PlaneXY(0, 0, 0))
parent_output = ParentOutput(O=ln_2)
g_pt_11 = ConstructPoint(XCoordinate=g_divide_2.Parameters, YCoordinate=g_divide_4.Parameters, ZCoordinate=g_slider2)
g_box_3 = Box2Pt(PointA=g_divide_3.Points, PointB=g_pt_8, Plane=PlaneXY(0, 0, 0))
parent_input = ParentInput()
brep = Brep([parent_input, g_box])
brep_2 = Brep([parent_input, g_box_2])
brep_3 = Brep([parent_input, g_box_3])
rgb = ColourRGB(Alpha=150, Red=255, Green=0, Blue=0)
brep_4 = Brep([brep, brep_2, brep_3])

# ---- group: Target Geometry
mesh = Mesh([<mesh referenced from the Rhino model> x13])
demesh = DeconstructMesh(Mesh=mesh)  # -> flatten(Vertices), Faces, Colours, Normals
sort_pt = SortPoints(Points=demesh.Vertices)  # -> Points, Indices

# ---- group: Generated Geometry
clean = CleanTree(Tree=brep_4, CleanInvalid=True, CleanEmpty=False)
mesh_2 = MeshBrep(
    Brep=clean,
    Settings={Refine=True, JaggedSeams=False, SimplePlanes=True, GridMinCount=16, GridMaxCount=0, Tolerance=0, RefineAngle=0, MinTolerance=0, RelativeTolerance=0.65, MinEdgeLength=0.0001, MaxEdgeLength=0})
demesh_2 = DeconstructMesh(Mesh=mesh_2)  # -> flatten(Vertices), Faces, Colours, Normals
preview = CustomPreview(
    Geometry=mesh_2,
    Shader={diffuse=RGB(255, 105, 180), ambient=RGB(0, 0, 0), emission=RGB(76, 32, 54), specular=RGB(255, 255, 255), shine=0.5, transparency=0})
sort_pt_2 = SortPoints(Points=demesh_2.Vertices)  # -> Points, Indices

# ----
preview_2 = CustomPreview(Geometry=mesh, Shader=rgb)
galapagos = Galapagos(fitness=filter, gene=[genes_3, genes, genes_2])
cp = ClosestPoint(Point=sort_pt.Points, Cloud=sort_pt_2.Points)  # -> ClosestPoint, CPIndex, Distance
dist = Distance(PointA=cp.ClosestPoint, PointB=sort_pt.Points)

# ---- group: Penalise Zero Result
ma = MassAddition(Input=dist)  # -> Result, PartialResults
larger = LargerThan(FirstNumber=ma.Result, SecondNumber=0)  # -> LargerThan, OrEqualTo
filter = StreamFilter(Gate=larger.LargerThan, Stream0=Slider(100000, range=0..100000), Stream1=ma.Result)

# ----
rec = DataRecorder(filter, RecordData=False, DataLimit=-10)
panel = Panel(rec)
