# Grasshopper definition ShapeAnalysis102 ExampleFile.gh (Grasshopper 0.9.76)
# plug-ins: Embryo

box = Box2Pt(Plane=PlaneXY(0, 0, 0))
divide = DivideCurve(Count=10, Kinks=False)  # -> Points, Tangents, Parameters
divide_2 = DivideCurve(Count=10, Kinks=False)  # -> Points, Tangents, Parameters
divide_3 = DivideCurve(Count=10, Kinks=False)  # -> Points, Tangents, Parameters
pt = ConstructPoint(XCoordinate=0, YCoordinate=0, ZCoordinate=0)
ln = Line()
pt_2 = ConstructPoint(XCoordinate=0, YCoordinate=0, ZCoordinate=0)
ln_2 = Line()
ln_3 = Line()
pt_3 = ConstructPoint(XCoordinate=0, YCoordinate=0, ZCoordinate=0)
pt_4 = ConstructPoint(XCoordinate=0, YCoordinate=0, ZCoordinate=0)
pt_5 = ConstructPoint(XCoordinate=0, YCoordinate=0, ZCoordinate=0)
g_slider68 = Slider(8.22, range=-10..10)
g_slider67 = Slider(-6.73, range=-10..10)
g_slider66 = Slider(-7.42, range=-10..10)
g_slider65 = Slider(2.39, range=-10..10)
g_slider64 = Slider(-9.86, range=-10..10)
g_slider63 = Slider(3.17, range=-10..10)
g_slider62 = Slider(-4.76, range=-10..10)
g_slider61 = Slider(6.2, range=-10..10)
g_slider60 = Slider(8.22, range=-10..10)
g_slider59 = Slider(-6.73, range=-10..10)
g_slider58 = Slider(-7.42, range=-10..10)
g_slider57 = Slider(2.39, range=-10..10)
g_slider56 = Slider(-9.86, range=-10..10)
g_slider55 = Slider(3.17, range=-10..10)
g_slider54 = Slider(-4.76, range=-10..10)
g_slider53 = Slider(6.2, range=-10..10)
g_slider52 = Slider(8.22, range=-10..10)
g_slider51 = Slider(-6.73, range=-10..10)
g_slider50 = Slider(-7.42, range=-10..10)
g_slider49 = Slider(2.39, range=-10..10)
g_slider48 = Slider(-9.86, range=-10..10)
g_slider47 = Slider(3.17, range=-10..10)
g_slider46 = Slider(-4.76, range=-10..10)
g_slider45 = Slider(6.2, range=-10..10)
g_slider44 = Slider(8.22, range=-10..10)
g_slider43 = Slider(-6.73, range=-10..10)
g_slider42 = Slider(-7.42, range=-10..10)
g_slider41 = Slider(2.39, range=-10..10)
g_slider40 = Slider(-9.86, range=-10..10)
g_slider39 = Slider(3.17, range=-10..10)
g_slider38 = Slider(-4.76, range=-10..10)
g_slider37 = Slider(6.2, range=-10..10)
g_slider36 = Slider(8.22, range=-10..10)
g_slider35 = Slider(-6.73, range=-10..10)
g_slider34 = Slider(-7.42, range=-10..10)
g_slider33 = Slider(2.39, range=-10..10)
g_slider32 = Slider(-9.86, range=-10..10)
g_slider31 = Slider(3.17, range=-10..10)
g_slider30 = Slider(-4.76, range=-10..10)
g_slider29 = Slider(6.2, range=-10..10)
g_slider28 = Slider(8.22, range=-10..10)
g_slider27 = Slider(-6.73, range=-10..10)
g_slider26 = Slider(-7.42, range=-10..10)
g_slider25 = Slider(2.39, range=-10..10)
g_slider24 = Slider(-9.86, range=-10..10)
g_slider23 = Slider(3.17, range=-10..10)
g_slider22 = Slider(-4.76, range=-10..10)
g_slider21 = Slider(6.2, range=-10..10)
g_slider20 = Slider(8.22, range=-10..10)
g_slider19 = Slider(-6.73, range=-10..10)
g_slider18 = Slider(-7.42, range=-10..10)
g_slider17 = Slider(2.39, range=-10..10)
g_slider16 = Slider(-9.86, range=-10..10)
g_slider15 = Slider(3.17, range=-10..10)
g_slider14 = Slider(-4.76, range=-10..10)
g_slider13 = Slider(6.2, range=-10..10)
g_slider12 = Slider(8.22, range=-10..10)
g_slider11 = Slider(-6.73, range=-10..10)
g_slider10 = Slider(-7.42, range=-10..10)
g_slider9 = Slider(2.39, range=-10..10)
g_slider8 = Slider(-9.86, range=-10..10)
g_slider7 = Slider(3.17, range=-10..10)
g_slider6 = Slider(-4.76, range=-10..10)
g_slider5 = Slider(6.2, range=-10..10)
g_slider4 = Slider(8.22, range=-10..10)
g_slider3 = Slider(-6.73, range=-10..10)
g_slider2 = Slider(-7.42, range=-10..10)
g_slider1 = Slider(2.39, range=-10..10)
g_slider0 = Slider(-9.86, range=-10..10)
genes = GenePool(
    Decimals=4,
    Maximum=6,
    Minimum=0,
    Value=[5.666196168, 0.0296103079, 4.379014271, 2.718238336, 1.909382663, 1.657549988, 2.053003883, 3.862118577, 1.237401224, 2.33782271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])
genes_2 = GenePool(
    Decimals=0,
    Maximum=100,
    Minimum=0,
    Value=[26.73421396, 40.26101215, 59.78163474, 56.823999, 57.26430735, 57.67900569, 58.71166268, 20.10347118, 7.315791402, 18.14695374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])
genes_3 = GenePool(
    Decimals=2,
    Maximum=10,
    Minimum=-10,
    Value=[-9.857929703, 2.387399549, -7.419436787, -6.733055756, 8.215302284, 6.201206341, -4.758719809, 3.170930852])
embryo = EmbryoSettings(Preview=False, SliderDomain=Domain(-10, 10), OneToOne=False, GridX=160, GridY=120, RemoveDead=True, OnlyTerminals=False)
g_pt = ConstructPoint(XCoordinate=g_slider17, YCoordinate=g_slider54, ZCoordinate=g_slider53)
g_pt_2 = ConstructPoint(XCoordinate=g_slider7, YCoordinate=g_slider19, ZCoordinate=g_slider66)
g_pt_3 = ConstructPoint(XCoordinate=g_slider27, YCoordinate=g_slider41, ZCoordinate=g_slider62)
g_pt_4 = ConstructPoint(XCoordinate=g_slider10, YCoordinate=g_slider58, ZCoordinate=g_slider57)
g_pt_5 = ConstructPoint(XCoordinate=g_slider50, YCoordinate=g_slider55, ZCoordinate=g_slider0)
g_pt_6 = ConstructPoint(XCoordinate=g_slider7, YCoordinate=g_slider19, ZCoordinate=g_slider66)
g_pt_7 = ConstructPoint(XCoordinate=g_slider27, YCoordinate=g_slider41, ZCoordinate=g_slider62)
g_pt_8 = ConstructPoint(XCoordinate=g_slider13, YCoordinate=g_slider58, ZCoordinate=g_slider57)
g_pt_9 = ConstructPoint(XCoordinate=g_slider7, YCoordinate=g_slider19, ZCoordinate=g_slider66)
g_pt_10 = ConstructPoint(XCoordinate=g_slider57, YCoordinate=g_slider59, ZCoordinate=g_slider61)
embryo_2 = Embryo(
    Reset=Toggle(True),
    Sliders=Slider(69, range=0..100),
    Components=Slider(40, range=10..40),
    MetricGenes=genes_3,
    TopologyGenes=genes_2,
    FunctionGenes=genes,
    Settings=embryo,
    RandomOveride=0)  # -> Iterations, Components
g_box = Box2Pt(PointA=g_pt_9, PointB=g_pt_5, Plane=PlaneXY(0, 0, 0))
g_ln = Line(StartPoint=g_pt_9, EndPoint=g_pt_10)
g_ln_2 = Line(StartPoint=g_pt_10, EndPoint=g_pt_9)
g_ln_3 = Line(StartPoint=g_pt_10, EndPoint=g_pt_9)
g_box_2 = Box2Pt(PointA=g_pt_9, PointB=g_pt_10, Plane=PlaneXY(0, 0, 0))
g_divide = DivideCurve(Curve=g_ln, Count=g_slider54, Kinks=False)  # -> Points, Tangents, Parameters
g_divide_2 = DivideCurve(Curve=g_ln_2, Count=g_slider57, Kinks=False)  # -> Points, Tangents, Parameters
g_divide_3 = DivideCurve(Curve=g_ln, Count=g_slider58, Kinks=False)  # -> Points, Tangents, Parameters
g_divide_4 = DivideCurve(Curve=g_ln, Count=g_slider53, Kinks=False)  # -> Points, Tangents, Parameters
g_divide_5 = DivideCurve(Curve=g_ln_2, Count=g_slider55, Kinks=False)  # -> Points, Tangents, Parameters
g_divide_6 = DivideCurve(Curve=g_ln, Count=g_slider53, Kinks=False)  # -> Points, Tangents, Parameters
g_divide_7 = DivideCurve(Curve=g_ln_2, Count=g_divide_6.Parameters, Kinks=False)  # -> Points, Tangents, Parameters
g_ln_4 = Line(StartPoint=g_pt_9, EndPoint=g_divide_5.Points)
g_box_3 = Box2Pt(PointA=g_divide_4.Points, PointB=g_pt_4, Plane=PlaneXY(0, 0, 0))
g_box_4 = Box2Pt(PointA=g_divide_2.Points, PointB=g_pt_3, Plane=PlaneXY(0, 0, 0))
g_ln_5 = Line(StartPoint=g_pt_6, EndPoint=g_divide_3.Points)
g_ln_6 = Line(StartPoint=g_divide_5.Points, EndPoint=g_pt_6)
g_pt_11 = ConstructPoint(XCoordinate=g_divide_6.Parameters, YCoordinate=g_slider17, ZCoordinate=g_slider0)
g_ln_7 = Line(StartPoint=g_pt_8, EndPoint=g_divide_6.Points)
g_ln_8 = Line(StartPoint=g_divide_6.Points, EndPoint=g_pt_10)
g_divide_8 = DivideCurve(Curve=g_ln_8, Count=g_slider27, Kinks=False)  # -> Points, Tangents, Parameters
g_divide_9 = DivideCurve(Curve=g_ln_8, Count=g_slider12, Kinks=False)  # -> Points, Tangents, Parameters
g_divide_10 = DivideCurve(Curve=g_ln_8, Count=g_divide_6.Parameters, Kinks=False)  # -> Points, Tangents, Parameters
g_box_5 = Box2Pt(PointA=g_divide_6.Points, PointB=g_pt_11, Plane=PlaneXY(0, 0, 0))
g_ln_9 = Line(StartPoint=g_divide_10.Points, EndPoint=g_divide_9.Points)
g_ln_10 = Line(StartPoint=g_pt_9, EndPoint=g_divide_10.Points)
g_ln_11 = Line(StartPoint=g_divide_3.Points, EndPoint=g_divide_9.Points)
g_ln_12 = Line(StartPoint=g_divide_4.Points, EndPoint=g_divide_9.Points)
g_divide_11 = DivideCurve(Curve=g_ln_9, Count=g_slider57, Kinks=False)  # -> Points, Tangents, Parameters
galapagos = Galapagos(fitness=filter, gene=[genes, genes_2, genes_3])
get_geometry = GetGeometry(G=[g_box_2, g_box_5, g_box_4, g_box_3, g_box])
rgb = ColourRGB(Alpha=150, Red=255, Green=0, Blue=0)

# ---- group: Target Geometry
mesh = Mesh([<mesh referenced from the Rhino model> x13])
demesh = DeconstructMesh(Mesh=mesh)  # -> flatten(Vertices), Faces, Colours, Normals
sort_pt = SortPoints(Points=demesh.Vertices)  # -> Points, Indices

# ----
preview = CustomPreview(Geometry=mesh, Shader=rgb)

# ---- group: Generated Geometry
clean = CleanTree(Tree=flatten(get_geometry), CleanInvalid=True, CleanEmpty=False)
mesh_2 = MeshBrep(
    Brep=clean,
    Settings={GridMaxCount=0, GridMinCount=16, JaggedSeams=False, MaxEdgeLength=0, MinEdgeLength=0.0001, MinTolerance=0, Refine=True, RefineAngle=0, RelativeTolerance=0.65, SimplePlanes=True, Tolerance=0})
demesh_2 = DeconstructMesh(Mesh=mesh_2)  # -> flatten(Vertices), Faces, Colours, Normals
sort_pt_2 = SortPoints(Points=demesh_2.Vertices)  # -> Points, Indices
preview_2 = CustomPreview(Geometry=mesh_2, Shader=ColourSwatch(SwatchColor=RGBA(255, 255, 255, 109)))

# ----
cp = ClosestPoint(Point=sort_pt.Points, Cloud=sort_pt_2.Points)  # -> ClosestPoint, CPIndex, Distance
dist = Distance(PointA=cp.ClosestPoint, PointB=sort_pt.Points)

# ---- group: Penalise Zero Result
ma = MassAddition(Input=dist)  # -> Result, PartialResults
larger = LargerThan(FirstNumber=ma.Result, SecondNumber=0)  # -> LargerThan, OrEqualTo
filter = StreamFilter(Gate=larger.LargerThan, Stream0=Slider(100000, range=0..100000), Stream1=ma.Result)

# ----
rec = DataRecorder(filter, DataLimit=-10, RecordData=False)
