# Grasshopper definition Simple test.gh (Grasshopper 1.0.7)
# plug-ins: Embryo

pt = ConstructPoint(XCoordinate=0, YCoordinate=0, ZCoordinate=0)
pl_3pt = Plane3Pt()
g_slider7 = Slider(6.588, range=-10..10)
g_slider6 = Slider(5.709, range=-10..10)
g_slider5 = Slider(0.569, range=-10..10)
g_slider4 = Slider(-2.351, range=-10..10)
g_slider3 = Slider(4.974, range=-10..10)
g_slider2 = Slider(3.965, range=-10..10)
g_slider1 = Slider(-1.761, range=-10..10)
g_slider0 = Slider(6.319, range=-10..10)
embryo = Embryo(
    Reset=Toggle(True),
    Sliders=8,
    Components=16,
    MetricGenes=2,
    TopologyGenes=2,
    FunctionGenes=2,
    Settings=null,
    RandomOveride=Slider(4, range=0..10))  # -> Iterations, Components
embryo_output = EmbryoOutput()
embryo_input = EmbryoInput()
g_pt = ConstructPoint(XCoordinate=0, YCoordinate=0, ZCoordinate=0)
g_pt_2 = ConstructPoint(XCoordinate=0, YCoordinate=0, ZCoordinate=0)
g_pt_3 = ConstructPoint(XCoordinate=0, YCoordinate=0, ZCoordinate=0)
g_pt_4 = ConstructPoint(XCoordinate=0, YCoordinate=0, ZCoordinate=0)
g_pt_5 = ConstructPoint(XCoordinate=g_slider2, YCoordinate=g_slider1, ZCoordinate=0)
g_pt_6 = ConstructPoint(XCoordinate=g_slider6, YCoordinate=g_slider4, ZCoordinate=g_slider5)
g_pt_7 = ConstructPoint(XCoordinate=g_slider3, YCoordinate=g_slider0, ZCoordinate=g_slider7)
