# Grasshopper definition TSP-Standard - BIG.gh (Grasshopper 0.9.70)
# plug-ins: Embryo

addition = Addition()
number_slider = Slider(9341834, range=0..100000000)
pop2d = Populate2D(Region={Plane=PlaneXY(0, 0, 0), Size=Domain2(u=0..20, v=0..10)}, Count=20, Seed=2)
g_slider2 = Slider(2, range=-10..10)
g_slider1 = Slider(2, range=-10..10)
g_slider0 = Slider(2, range=-10..10)
item = ListItem(List=pop2d, Index=16, Wrap=True)
item_2 = ListItem(List=pop2d, Index=15, Wrap=True)
item_3 = ListItem(List=pop2d, Index=18, Wrap=True)
item_4 = ListItem(List=pop2d, Index=19, Wrap=True)
item_5 = ListItem(List=pop2d, Index=17, Wrap=True)
item_6 = ListItem(List=pop2d, Index=14, Wrap=True)
item_7 = ListItem(List=pop2d, Index=13, Wrap=True)
item_8 = ListItem(List=pop2d, Index=12, Wrap=True)
item_9 = ListItem(List=pop2d, Index=11, Wrap=True)
item_10 = ListItem(List=pop2d, Index=6, Wrap=True)
item_11 = ListItem(List=pop2d, Index=10, Wrap=True)
item_12 = ListItem(List=pop2d, Index=5, Wrap=True)
item_13 = ListItem(List=pop2d, Index=8, Wrap=True)
item_14 = ListItem(List=pop2d, Index=9, Wrap=True)
item_15 = ListItem(List=pop2d, Index=7, Wrap=True)
item_16 = ListItem(List=pop2d, Index=4, Wrap=True)
item_17 = ListItem(List=pop2d, Index=3, Wrap=True)
item_18 = ListItem(List=pop2d, Index=2, Wrap=True)
item_19 = ListItem(List=pop2d, Index=1, Wrap=True)
item_20 = ListItem(List=pop2d, Index=0, Wrap=True)
jitter = Jitter(List=pop2d, Jitter=1, Seed=number_slider)  # -> Values, Indices
pt = Point(item_7)
pt_2 = Point(item_2)
pt_3 = Point(item_11)
pt_4 = Point(item)
pt_5 = Point(item_3)
pt_6 = Point(item_9)
pt_7 = Point(item_4)
pt_8 = Point(item_5)
pt_9 = Point(item_6)
pt_10 = Point(item_17)
pt_11 = Point(item_12)
pt_12 = Point(item_8)
pt_13 = Point(item_20)
pt_14 = Point(item_10)
pt_15 = Point(item_19)
pt_16 = Point(item_13)
pt_17 = Point(item_14)
pt_18 = Point(item_15)
pt_19 = Point(item_18)
pt_20 = Point(item_16)
pline = PolyLine(Vertices=jitter.Values, Closed=True)
len = Length(Curve=pline)
genes = GenePool(Decimals=0, Maximum=32, Minimum=0, Value=[11, 0, 1, 0, 7, 30, 26, 31, 32, 20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])
embryo = EmbryoSettings(Preview=True, SliderDomain=Domain(-10, 10), OneToOne=True, GridX=120, GridY=120, RemoveDead=False, OnlyTerminals=False)
galapagos = Galapagos(fitness=len, gene=number_slider)
parent_output = ParentOutput(O=[pt_19, pt_10, pt_20, pt_11, pt_14, pt_18, pt_16, pt_17, pt_15, pt_13, pt_3, pt_6, pt_12, pt, pt_9, pt_2, pt_4, pt_8, pt_5, pt_7])
parent_input = ParentInput()
parent_input_2 = ParentInput()
g_a_b = Addition(A=g_slider2, B=g_slider0)
embryo_2 = Embryo(
    Reset=Toggle(True),
    Sliders=3,
    Components=1,
    MetricGenes=2,
    TopologyGenes=genes,
    FunctionGenes=2,
    Settings=embryo,
    RandomOveride=0)  # -> Iterations, Components
pt_21 = Point([parent_input, pt_17])
pt_22 = Point([parent_input, pt_12])
pt_23 = Point([parent_input, pt_13])
pt_24 = Point([parent_input_2, pt_3])
pt_25 = Point([parent_input_2, pt_18])
pt_26 = Point([parent_input, pt_8])
pt_27 = Point([parent_input_2, pt_10])
pt_28 = Point([parent_input, pt_19])
pt_29 = Point([parent_input_2, pt_5])
pt_30 = Point([parent_input, pt_16])
pt_31 = Point([parent_input, pt_2])
pt_32 = Point([parent_input, pt_11])
pt_33 = Point([parent_input, pt_15])
pt_34 = Point([parent_input, pt_4])
pt_35 = Point([parent_input_2, pt])
pt_36 = Point([parent_input_2, pt_20])
pt_37 = Point([parent_input_2, pt_7])
pt_38 = Point([parent_input_2, pt_14])
pt_39 = Point([parent_input_2, pt_6])
pt_40 = Point([parent_input_2, pt_9])
pline_2 = PolyLine(
    Vertices=[pt_21, pt_22, pt_23, pt_26, pt_28, pt_30, pt_33, pt_31, pt_32, pt_34, pt_24, pt_25, pt_27, pt_29, pt_35, pt_36, pt_39, pt_37, pt_38, pt_40],
    Closed=True)
galapagos_2 = Galapagos(fitness=len_2, gene=genes)
len_2 = Length(Curve=pline_2)
preview = CustomPreview(Geometry=pline_2, Shader=ColourSwatch(SwatchColor=RGB(0, 0, 255)))
