# Grasshopper definition TSP-Standard.gh (Grasshopper 0.9.70)
# plug-ins: Embryo

addition = Addition()
number_slider = Slider(64004300, range=0..100000000)
pop2d = Populate2D(Region={Plane=PlaneXY(0, 0, 0), Size=Domain2(u=0..20, v=0..10)}, Count=10, Seed=1)
g_slider2 = Slider(2, range=-10..10)
g_slider1 = Slider(2, range=-10..10)
g_slider0 = Slider(2, range=-10..10)
genes = GenePool(Decimals=0, Maximum=12, Minimum=0, Value=[1, 2, 6, 3, 6, 0, 2, 1, 4, 1, 8, 4])
embryo = EmbryoSettings(Preview=True, SliderDomain=Domain(-10, 10), OneToOne=True, GridX=120, GridY=120, RemoveDead=False, OnlyTerminals=False)
item = ListItem(List=pop2d, Index=6, Wrap=True)
item_2 = ListItem(List=pop2d, Index=5, Wrap=True)
item_3 = ListItem(List=pop2d, Index=8, Wrap=True)
item_4 = ListItem(List=pop2d, Index=9, Wrap=True)
item_5 = ListItem(List=pop2d, Index=7, Wrap=True)
item_6 = ListItem(List=pop2d, Index=4, Wrap=True)
item_7 = ListItem(List=pop2d, Index=3, Wrap=True)
item_8 = ListItem(List=pop2d, Index=2, Wrap=True)
item_9 = ListItem(List=pop2d, Index=1, Wrap=True)
item_10 = ListItem(List=pop2d, Index=0, Wrap=True)
jitter = Jitter(List=pop2d, Jitter=1, Seed=number_slider)  # -> Values, Indices
pt = Point(item_7)
pt_2 = Point(item_2)
pt_3 = Point(item_10)
pt_4 = Point(item)
pt_5 = Point(item_9)
pt_6 = Point(item_3)
pt_7 = Point(item_4)
pt_8 = Point(item_5)
pt_9 = Point(item_8)
pt_10 = Point(item_6)
pline = PolyLine(Vertices=jitter.Values, Closed=True)
embryo_2 = Embryo(
    Reset=Toggle(True),
    Sliders=3,
    Components=1,
    MetricGenes=2,
    TopologyGenes=genes,
    FunctionGenes=2,
    Settings=embryo,
    RandomOveride=0)  # -> Iterations, Components
len = Length(Curve=pline)
galapagos = Galapagos(fitness=len, gene=number_slider)
parent_output = ParentOutput(O=[pt_9, pt, pt_10, pt_2, pt_4, pt_8, pt_6, pt_7, pt_5, pt_3])
galapagos_2 = Galapagos(fitness=len_2, gene=genes)
parent_input = ParentInput()
g_a_b = Addition(A=g_slider1, B=g_slider0)
pt_11 = Point([parent_input, pt_6])
pt_12 = Point([parent_input, pt_9])
pt_13 = Point([parent_input, pt_2])
pt_14 = Point([parent_input, pt_10])
pt_15 = Point([parent_input, pt_5])
pt_16 = Point([parent_input, pt_4])
pt_17 = Point([parent_input, pt_7])
pt_18 = Point([parent_input, pt_3])
pt_19 = Point([parent_input, pt])
pt_20 = Point([parent_input, pt_8])
pline_2 = PolyLine(Vertices=[pt_11, pt_12, pt_13, pt_14, pt_15, pt_16, pt_19, pt_17, pt_18, pt_20], Closed=True)
len_2 = Length(Curve=pline_2)
preview = CustomPreview(Geometry=pline_2, Shader=ColourSwatch(SwatchColor=RGB(0, 0, 255)))
