# Grasshopper definition TSP001.gh (Grasshopper 0.9.70)
# plug-ins: Embryo

addition = Addition()
g_slider2 = Slider(2, range=-10..10)
g_slider1 = Slider(2, range=-10..10)
g_slider0 = Slider(2, range=-10..10)
genes = GenePool(Decimals=0, Maximum=4, Minimum=0, Value=[1, 3, 0, 2, 1, 0, 3])
embryo = EmbryoSettings(Preview=True, SliderDomain=Domain(-10, 10), OneToOne=True, GridX=120, GridY=120, RemoveDead=False, OnlyTerminals=False)
pt = Point(Point(-5.637596974, -3.40733883, 0))
pt_2 = Point(Point(3.53124206, 4.646371132, 0))
pt_3 = Point(Point(0.3097580755, 12.45227463, 0))
pt_4 = Point(Point(14.31082309, 1.300983917, 0))
parent_output = ParentOutput(O=[pt, pt_4, pt_2, pt_3])
embryo_2 = Embryo(
    Reset=Toggle(True),
    Sliders=3,
    Components=1,
    MetricGenes=2,
    TopologyGenes=genes,
    FunctionGenes=2,
    Settings=embryo,
    RandomOveride=0)  # -> Iterations, Components
parent_input = ParentInput()
pt_5 = Point([parent_input, pt_3])
pt_6 = Point([parent_input, pt_2])
pt_7 = Point([parent_input, pt])
pt_8 = Point([parent_input, pt_4])
pline = PolyLine(Vertices=[pt_8, pt_7, pt_5, pt_6], Closed=True)
galapagos = Galapagos(fitness=len, gene=genes)
g_a_b = Addition(A=g_slider1, B=g_slider2)
len = Length(Curve=pline)
