# Grasshopper definition TowerHamlets003.gh (Grasshopper 0.9.76)
# plug-ins: Embryo

# E02.
# 
# In this example the form generated is slightly more complex than E01 due to the inclusion of a divide component.
# 
# The settings component is also introduced.
box = Box2Pt(Plane=PlaneXY(0, 0, 0))
box_corners = BoxCorners()  # -> CornerA, CornerB, CornerC, CornerD, CornerE, CornerF, CornerG, CornerH
vec = VectorXYZ(XComponent=0, YComponent=0, ZComponent=0)  # -> Vector, Length; disabled

# ----
# Setting RemoveDead to True will remove any components that have either a warning or error flag (note: this is just a visibility toggle, such compoents will never be connected to once they are not clean).
# The settings component contains extra user preferences such as whether a preview is displayed, the parameter domains, grid size, etc...
toggle = BooleanToggle(True)
embryo = EmbryoSettings(
    Preview=True,
    SliderDomain=Domain(-10, 10),
    OneToOne=Toggle(True),
    GridX=Slider(119, range=0..1000),
    GridY=Slider(182, range=0..1000),
    RemoveDead=toggle,
    OnlyTerminals=Toggle(False))

embryo_2 = Embryo(
    Reset=Toggle(True),
    Sliders=Slider(0, range=0..100),
    Components=Slider(21, range=0..100),
    MetricGenes=2,
    TopologyGenes=2,
    FunctionGenes=2,
    Settings=embryo,
    RandomOveride=Slider(58, range=0..100))  # -> Iterations, Components
colstep = ColumnStep(Components=embryo_2.Components, LastColumn=Slider(7, range=0..10))
box_2 = CenterBox(Base=PlaneXY(0, 0, 0), X=Slider(9.504, range=0..100), Y=Slider(9.504, range=0..100), Z=5)
pi = Pi(Factor=1)
box_3 = CenterBox(Base=PlaneXY(0, 0, 0), X=1, Y=5, Z=1)
g_box_corners = BoxCorners(Box=box_3)  # -> CornerA, CornerB, CornerC, CornerD, CornerE, CornerF, CornerG, CornerH
g_box = Box2Pt(PointA=g_box_corners.CornerH, PointB=g_box_corners.CornerC, Plane=PlaneXY(0, 0, 0))
g_box_2 = Box2Pt(PointA=g_box_corners.CornerG, PointB=g_box_corners.CornerC, Plane=PlaneXY(0, 0, 0))
g_box_3 = Box2Pt(PointA=g_box_corners.CornerE, PointB=g_box_corners.CornerH, Plane=PlaneXY(0, 0, 0))
g_box_4 = Box2Pt(PointA=g_box_corners.CornerB, PointB=g_box_corners.CornerD, Plane=PlaneXY(0, 0, 0))
division = Division(A=pi, B=Slider(2, range=0..10))
parent_output = ParentOutput(O=box_2)
g_box_corners_2 = BoxCorners(Box=g_box_2)  # -> CornerA, CornerB, CornerC, CornerD, CornerE, CornerF, CornerG, CornerH
parent_output_2 = ParentOutput(O=division)
g_box_5 = Box2Pt(PointA=g_box_corners_2.CornerH, PointB=g_box_corners_2.CornerE, Plane=PlaneXY(0, 0, 0))
g_box_6 = Box2Pt(PointA=g_box_corners_2.CornerG, PointB=g_box_corners_2.CornerC, Plane=PlaneXY(0, 0, 0))
g_box_7 = Box2Pt(PointA=g_box_corners_2.CornerB, PointB=g_box_corners_2.CornerE, Plane=PlaneXY(0, 0, 0))
g_box_8 = Box2Pt(PointA=g_box_corners_2.CornerG, PointB=g_box_corners.CornerC, Plane=PlaneXY(0, 0, 0))
parent_output_3 = ParentOutput(O=box_3)
g_box_corners_3 = BoxCorners(Box=g_box_8)  # -> CornerA, CornerB, CornerC, CornerD, CornerE, CornerF, CornerG, CornerH
g_box_corners_4 = BoxCorners(Box=g_box_8)  # -> CornerA, CornerB, CornerC, CornerD, CornerE, CornerF, CornerG, CornerH
g_box_9 = Box2Pt(PointA=g_box_corners_3.CornerC, PointB=g_box_corners_3.CornerE, Plane=PlaneXY(0, 0, 0))
g_box_10 = Box2Pt(PointA=g_box_corners_4.CornerF, PointB=g_box_corners_2.CornerE, Plane=PlaneXY(0, 0, 0))
g_box_11 = Box2Pt(PointA=g_box_corners_4.CornerC, PointB=g_box_corners_4.CornerH, Plane=PlaneXY(0, 0, 0))
vec_2 = VectorXYZ(XComponent=0, YComponent=0, ZComponent=0)  # -> Vector, Length
g_box_corners_5 = BoxCorners(Box=g_box_10)  # -> CornerA, CornerB, CornerC, CornerD, CornerE, CornerF, CornerG, CornerH
g_box_corners_6 = BoxCorners(Box=g_box_10)  # -> CornerA, CornerB, CornerC, CornerD, CornerE, CornerF, CornerG, CornerH
g_box_corners_7 = BoxCorners(Box=g_box_11)  # -> CornerA, CornerB, CornerC, CornerD, CornerE, CornerF, CornerG, CornerH
g_box_12 = Box2Pt(PointA=g_box_corners_6.CornerC, PointB=g_box_corners_6.CornerG, Plane=PlaneXY(0, 0, 0))
g_box_13 = Box2Pt(PointA=g_box_corners_2.CornerE, PointB=g_box_corners_7.CornerA, Plane=PlaneXY(0, 0, 0))
tr = TypeRevealer(Input=vec_2.Vector)  # -> ComponentClass, ParameterTypeName, ParameterClass, VolatileDataType
