# Grasshopper definition WIP_example-005-parentoutput_input.gh (Grasshopper 0.9.76)
# plug-ins: Embryo

debrep = DeconstructBrep()  # -> Faces, Edges, Vertices
box = CenterBox(Base=PlaneXY(0, 0, 0), X=1, Y=1, Z=1)

# ---- group: These can be adjusted after definition is generated
number_slider = Slider(26, range=0..100)
number_slider_2 = Slider(2.88, range=0..10)
number_slider_3 = Slider(10, range=0..100)

# ----
pt = ConstructPoint(XCoordinate=0, YCoordinate=0, ZCoordinate=0)
g_slider5 = Slider(-5.18, range=-10..10)
g_slider4 = Slider(7.062, range=-10..10)
g_slider3 = Slider(9.987, range=-10..10)
g_slider2 = Slider(0.645, range=-10..10)
g_slider1 = Slider(-0.446, range=-10..10)
g_slider0 = Slider(-4.577, range=-10..10)
line = LineSDL(Start=pt, Direction=Vector(0, 0, 1), Length=number_slider)
embryo = EmbryoSettings(Preview=False, SliderDomain=Domain(-10, 10), OneToOne=False, GridX=160, GridY=120, RemoveDead=True, OnlyTerminals=False)
pframes = PerpFrames(Curve=line, Count=number_slider_3, Align=True)  # -> Frames, Parameters
multiplication = Multiplication(A=pframes.Parameters, B=number_slider_2)
rotate = Rotate(Geometry=pframes.Frames, Angle=multiplication, Plane=PlaneXY(0, 0, 0))  # -> Geometry, Transform
pln = Plane(rotate.Geometry)
embryo_2 = Embryo(
    Reset=Toggle(True),
    Sliders=Slider(6, range=0..10),
    Components=Slider(6, range=0..100),
    MetricGenes=2,
    TopologyGenes=2,
    FunctionGenes=2,
    Settings=embryo,
    RandomOveride=Slider(604, range=0..1000))  # -> Iterations, Components
g_box = CenterBox(Base=pln, X=g_slider2, Y=g_slider5, Z=g_slider3)

# ---- group: Tag output parameters to be used
parent_output = ParentOutput(O=pln)

# ----
g_debrep = DeconstructBrep(Brep=g_box)  # -> Faces, Edges, Vertices
g_debrep_2 = DeconstructBrep(Brep=g_box)  # -> Faces, Edges, Vertices
g_box_2 = CenterBox(Base=g_debrep_2.Vertices, X=g_slider3, Y=g_slider1, Z=g_slider2)

# ---- group: Use parent inputs to get a specific datatype
parent_input = ParentInput()
parent_input_2 = ParentInput()
brep = Brep(flatten([parent_input_2, g_debrep_2.Faces]))
brep_2 = Brep(flatten([parent_input, g_box]))

# ----
Z = UnitZ(Factor=Slider(2, range=0..10))
bbox = BoundingBox(Content=brep, Plane=PlaneXY(0, 0, 0), UnionBox=True)  # -> Box, Box_2
move = Move(Geometry=brep, Motion=Z)  # -> Geometry, Transform
debox = DeconstructBox(Box=bbox.Box)  # -> Plane, X, Y, Z
dedomain = DeconstructDomain(Domain=debox.Y)  # -> Start, End
cyl = Cylinder(Base=PlaneXY(0, 0, 0), Radius=expr("x*0.8", dedomain.Start), Length=number_slider)
preview = CustomPreview(Geometry=brep_2, Shader=ColourSwatch(SwatchColor=RGB(0, 0, 0)))
preview_2 = CustomPreview(Geometry=move.Geometry, Shader=ColourSwatch(SwatchColor=RGB(255, 255, 255)))
cap = CapHoles(Brep=cyl)
preview_3 = CustomPreview(
    Geometry=cap,
    Shader={ambient=RGB(0, 0, 0), diffuse=RGB(255, 105, 180), emission=RGB(76, 32, 54), shine=0.5, specular=RGB(255, 255, 255), transparency=0})
