# Grasshopper definition example-003-galapagos.gh (Grasshopper 1.0.7)
# plug-ins: Embryo

# In this example, we use Embryo to solve a combinatorial numbers problem.
# 
# Double-click on the galapagos component to start, making sure to minimise the problem not maximise!
# 
# The genome for the optimisation is the random topology input. The fitness is the absolute distance from the target result (314).
# 
# As currently the topology seed is random, it is only solved by brute-force in this example.
# 
# For more complex problems, we can use a gene pool for each numeric, functional and topological aspects of Embryo
# 
# Note the use of the One-to-One setting.
addition = Addition()
subtraction = Subtraction()
multiplication = Multiplication()
slider = Slider(4, range=0..4)
slider_2 = Slider(5, range=0..5)
slider_3 = Slider(6, range=0..6)
slider_4 = Slider(7, range=0..7)
slider_5 = Slider(25, range=0..25)
slider_6 = Slider(50, range=0..50)
embryo = EmbryoSettings(
    Preview=True,
    SliderDomain=Domain(-10, 10),
    OneToOne=Toggle(True),
    GridX=100,
    GridY=70,
    RemoveDead=False,
    OnlyTerminals=False)
parent_output = ParentOutput(O=[slider, slider_2, slider_3, slider_4, slider_5, slider_6])
genes = GenePool(Decimals=0, Maximum=12, Minimum=0, Value=[9, 5, 5, 9, 0, 10, 6, 3, 1, 6])
genes_2 = GenePool(Decimals=0, Maximum=3, Minimum=0, Value=[1, 0, 0, 2, 0])
g_a_b = Addition(A=slider_2, B=slider_4)
g_a_b_2 = Addition(A=slider_5, B=slider)
g_a_b_3 = Subtraction(A=slider_3, B=slider_6)
embryo_2 = Embryo(
    Reset=Toggle(True),
    Sliders=Slider(0, range=0..100),
    Components=Slider(5, range=0..10),
    MetricGenes=2,
    TopologyGenes=genes,
    FunctionGenes=genes_2,
    Settings=embryo,
    RandomOveride=0)  # -> Iterations, Components
g_a_b_4 = Multiplication(A=g_a_b, B=g_a_b_2)
g_a_b_5 = Addition(A=g_a_b_3, B=g_a_b_4)
target = Slider(314, range=0..1000)
parent_input = ParentInput()
int = Integer([parent_input, g_a_b_5])
galapagos = Galapagos(fitness=abs, gene=[genes, genes_2])
subtraction_2 = Subtraction(A=target, B=int)
abs = Absolute(Value=subtraction_2)
panel = Panel(abs)
