# Grasshopper definition example-004-shapeanalysis.gh (Grasshopper 0.9.76)
# plug-ins: Embryo

box = Box2Pt(Plane=PlaneXY(0, 0, 0))
box_2 = Box2Pt(Plane=PlaneXY(0, 0, 0))
divide = DivideCurve(Count=10, Kinks=False)  # -> Points, Tangents, Parameters
ln = Line()
pt = ConstructPoint(XCoordinate=0, YCoordinate=0, ZCoordinate=0)
pt_2 = ConstructPoint(XCoordinate=0, YCoordinate=0, ZCoordinate=0)
# Gene pool contains same number of sliders
# (cannot be attached to slider unfortunately).
# Values correspond to slider values.
genes = GenePool(
    Decimals=0,
    Maximum=60,
    Minimum=0,
    Value=[27.66070782, 28.7169612, 58.61939331, 57.10937429, 46.10638338, 23.07774585, 50.78878264, 14.7303807, 11.80992843, 49.28519393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])
genes_2 = GenePool(
    Decimals=2,
    Maximum=10,
    Minimum=-10,
    Value=[-5.400037167, -8.287678733, 9.850699436, -9.295891309, 6.060451677, 2.239278179, -9.344715262, -5.5262461])
# Gene pool contains same number of Component inputs.
# A decent guess is no. of components x 3, which for this example is 60.
# Min = 0. Max = 60.
# Gene pool contains same number of Components which for this example is 20.
# Range corresponds to the number of ingredient components:
# Min = 0. Max = 5.
genes_3 = GenePool(
    Decimals=0,
    Maximum=6,
    Minimum=0,
    Value=[4.67538395, 2.31745841, 5.551208432, 2.52921449, 1.741531542, 0.6103947901, 2.595739417, 3.967245705, 2.102643344, 0.7774195051, 1.555778267, 3.228501668, 3.360648856, 1.906215167, 4.193278424, 4.745804359, 5.706637613, 5.503207502, 5.619266689, 1.065678489])
g_slider7 = Slider(-5.53, range=-10..10)
g_slider6 = Slider(-9.34, range=-10..10)
g_slider5 = Slider(2.24, range=-10..10)
g_slider4 = Slider(6.06, range=-10..10)
g_slider3 = Slider(-9.3, range=-10..10)
g_slider2 = Slider(9.85, range=-10..10)
g_slider1 = Slider(-8.29, range=-10..10)
g_slider0 = Slider(-5.4, range=-10..10)
embryo = EmbryoSettings(Preview=False, SliderDomain=Domain(-10, 10), OneToOne=False, GridX=160, GridY=120, RemoveDead=True, OnlyTerminals=False)
g_pt = ConstructPoint(XCoordinate=g_slider3, YCoordinate=g_slider1, ZCoordinate=g_slider5)
g_pt_2 = ConstructPoint(XCoordinate=g_slider3, YCoordinate=g_slider7, ZCoordinate=g_slider2)
g_pt_3 = ConstructPoint(XCoordinate=g_slider4, YCoordinate=g_slider0, ZCoordinate=g_slider3)
g_pt_4 = ConstructPoint(XCoordinate=g_slider4, YCoordinate=g_slider0, ZCoordinate=g_slider7)
embryo_2 = Embryo(
    Reset=Toggle(True),
    Sliders=Slider(8, range=0..10),
    Components=Slider(20, range=0..100),
    MetricGenes=genes_2,
    TopologyGenes=genes,
    FunctionGenes=genes_3,
    Settings=embryo,
    RandomOveride=0)  # -> Iterations, Components
g_ln = Line(StartPoint=g_pt_3, EndPoint=g_pt_4)
g_ln_2 = Line(StartPoint=g_pt_3, EndPoint=g_pt_4)
g_divide = DivideCurve(Curve=g_ln, Count=g_slider6, Kinks=False)  # -> Points, Tangents, Parameters
g_divide_2 = DivideCurve(Curve=g_ln_2, Count=g_slider4, Kinks=False)  # -> Points, Tangents, Parameters
g_box = Box2Pt(PointA=g_pt_4, PointB=g_pt_2, Plane=g_divide_2.Points)
g_ln_3 = Line(StartPoint=g_divide_2.Points, EndPoint=g_pt_3)
g_box_2 = Box2Pt(PointA=g_pt_3, PointB=g_pt_4, Plane=g_divide_2.Points)
g_box_3 = Box2Pt(PointA=g_pt_3, PointB=g_pt_4, Plane=g_divide_2.Points)
g_pt_5 = ConstructPoint(XCoordinate=g_divide_2.Parameters, YCoordinate=g_slider5, ZCoordinate=g_slider3)
g_pt_6 = ConstructPoint(XCoordinate=g_slider1, YCoordinate=g_divide_2.Parameters, ZCoordinate=g_slider3)
parent_input = ParentInput()
brep = Brep(parent_input)
brep_2 = Brep([parent_input, g_box_3])
brep_3 = Brep([parent_input, g_box])
brep_4 = Brep([parent_input, g_box_2])
brep_5 = Brep([brep_2, brep_3, brep_4, brep])
rgb = ColourRGB(Alpha=150, Red=255, Green=0, Blue=0)

# ---- group: Target Geometry
mesh = Mesh([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])
demesh = DeconstructMesh(Mesh=mesh)  # -> flatten(Vertices), Faces, Colours, Normals
sort_pt = SortPoints(Points=demesh.Vertices)  # -> Points, Indices

# ---- group: Generated Geometry
clean = CleanTree(Tree=brep_5, CleanInvalid=True, CleanEmpty=False)
mesh_2 = MeshBrep(
    Brep=clean,
    Settings={GridMaxCount=0, GridMinCount=16, JaggedSeams=False, MaxEdgeLength=0, MinEdgeLength=0.0001, MinTolerance=0, Refine=True, RefineAngle=0, RelativeTolerance=0.65, SimplePlanes=True, Tolerance=0})
demesh_2 = DeconstructMesh(Mesh=mesh_2)  # -> flatten(Vertices), Faces, Colours, Normals
preview = CustomPreview(
    Geometry=mesh_2,
    Shader={ambient=RGB(0, 0, 0), diffuse=RGB(255, 105, 180), emission=RGB(76, 32, 54), shine=0.5, specular=RGB(255, 255, 255), transparency=0})
sort_pt_2 = SortPoints(Points=demesh_2.Vertices)  # -> Points, Indices

# ----
preview_2 = CustomPreview(Geometry=mesh, Shader=rgb)
cp = ClosestPoint(Point=sort_pt.Points, Cloud=sort_pt_2.Points)  # -> ClosestPoint, CPIndex, Distance
dist = Distance(PointA=cp.ClosestPoint, PointB=sort_pt.Points)

# ---- group: Penalise Zero Result
ma = MassAddition(Input=dist)  # -> Result, PartialResults
larger = LargerThan(FirstNumber=ma.Result, SecondNumber=0)  # -> LargerThan, OrEqualTo
filter = StreamFilter(Gate=larger.LargerThan, Stream0=Slider(100000, range=0..100000), Stream1=ma.Result)

# ----
galapagos = Galapagos(fitness=filter, gene=[genes_3, genes, genes_2])
