# Grasshopper definition example_001-basics.gh (Grasshopper 0.9.76)
# plug-ins: Embryo

# The number of component copies affects the probability of it being selected.
# You can only put components in here (not parameters),
# They can be any compiled component, including custom ones.
# It doesn't matter if the component has a warning.
# At present, the persistent data is always by default although this will change in future.
# Any disabled components will be ignored.
pt = ConstructPoint(XCoordinate=0, YCoordinate=0, ZCoordinate=0)
ln = Line()
# The metric, topological and function genes can be negated using a random override seed.
# With the override, you can supply gene pools to the above (see later examples).
# This is useful for combining definitions with metaheuristic algorithms.
number_slider = Slider(3495, range=0..10000)
# The canvas is divided into quadrants.
# The parent canvas (this bit) is as per usual.
# The ingredients quadrant contains components to be used in the generated definition.
# The child quadrant is where the generated definition lies.
# The other quadrant is where dragons live.
# Set to True
number_slider_2 = Slider(4, range=0..100)
embryo = EmbryoSettings(
    Preview=Toggle(True),
    SliderDomain=Domain(-10, 10),
    OneToOne=Toggle(False),
    GridX=120,
    GridY=120,
    RemoveDead=True,
    OnlyTerminals=False)
# Here is where your definition will be generated.
# If any components are located here that have been made manually (i.e. not by Embryo),
# they will be included individually in the generated definition.
# The generation is topologically sorted (i.e. each column is a dependency hierarchy)
toggle = BooleanToggle(False)
embryo_2 = Embryo(
    Reset=toggle,
    Sliders=number_slider_2,
    Components=Slider(8, range=0..100),
    MetricGenes=2,
    TopologyGenes=2,
    FunctionGenes=2,
    Settings=embryo,
    RandomOveride=number_slider)  # -> Iterations, Components
