# Grasshopper definition tempTowerHamlets.gh (Grasshopper 0.9.76)
# plug-ins: Embryo

rotate = Rotate(Angle=1.570796327, Plane=PlaneXY(0, 0, 0))  # -> Geometry, Transform
vec = VectorXYZ(XComponent=0, YComponent=0, ZComponent=0)  # -> Vector, Length; disabled
box_corners = BoxCorners()  # -> CornerA, CornerB, CornerC, CornerD, CornerE, CornerF, CornerG, CornerH
# E02.
# 
# In this example the form generated is slightly more complex than E01 due to the inclusion of a divide component.
# 
# The settings component is also introduced.
vec2pt = Vector2Pt(Unitize=False)  # -> Vector, Length
move = Move(Motion=Vector(0, 0, 10))  # -> Geometry, Transform
number_slider = Slider(15, range=0..100)
g_slider14 = Slider(-1.447, range=-10..10)
g_slider13 = Slider(-7.457, range=-10..10)
g_slider12 = Slider(0.751, range=-10..10)
g_slider11 = Slider(5.816, range=-10..10)
g_slider10 = Slider(-9.984, range=-10..10)
g_slider9 = Slider(0.301, range=-10..10)
g_slider8 = Slider(6.722, range=-10..10)
g_slider7 = Slider(3.977, range=-10..10)
g_slider6 = Slider(0.869, range=-10..10)
g_slider5 = Slider(-9.699, range=-10..10)
g_slider4 = Slider(2.622, range=-10..10)
g_slider3 = Slider(-8.525, range=-10..10)
g_slider2 = Slider(-5.123, range=-10..10)
g_slider1 = Slider(-2.233, range=-10..10)
g_slider0 = Slider(-1.123, range=-10..10)

# ----
# Setting RemoveDead to True will remove any components that have either a warning or error flag (note: this is just a visibility toggle, such compoents will never be connected to once they are not clean).
# The settings component contains extra user preferences such as whether a preview is displayed, the parameter domains, grid size, etc...
toggle = BooleanToggle(True)
embryo = EmbryoSettings(
    Preview=True,
    SliderDomain=Domain(-10, 10),
    OneToOne=False,
    GridX=120,
    GridY=120,
    RemoveDead=toggle,
    OnlyTerminals=Toggle(True))

embryo_2 = Embryo(
    Reset=Toggle(True),
    Sliders=number_slider,
    Components=number_slider,
    MetricGenes=2,
    TopologyGenes=2,
    FunctionGenes=2,
    Settings=embryo,
    RandomOveride=Slider(32, range=0..100))  # -> Iterations, Components
box = CenterBox(Base=PlaneXY(0, 0, 0), X=10, Y=1, Z=1)
g_rotate = Rotate(Geometry=box, Angle=g_slider2, Plane=PlaneXY(0, 0, 0))  # -> Geometry, Transform
g_move = Move(Geometry=box, Motion=Vector(0, 0, 10))  # -> Geometry, Transform
g_rotate_2 = Rotate(Geometry=box, Angle=g_slider6, Plane=PlaneXY(0, 0, 0))  # -> Geometry, Transform
g_move_2 = Move(Geometry=box, Motion=Vector(0, 0, 10))  # -> Geometry, Transform
g_box_corners = BoxCorners(Box=box)  # -> CornerA, CornerB, CornerC, CornerD, CornerE, CornerF, CornerG, CornerH
g_box_corners_2 = BoxCorners(Box=box)  # -> CornerA, CornerB, CornerC, CornerD, CornerE, CornerF, CornerG, CornerH
g_box_corners_3 = BoxCorners(Box=box)  # -> CornerA, CornerB, CornerC, CornerD, CornerE, CornerF, CornerG, CornerH
g_box_corners_4 = BoxCorners(Box=box)  # -> CornerA, CornerB, CornerC, CornerD, CornerE, CornerF, CornerG, CornerH
parent_output = ParentOutput(O=box)
g_rotate_3 = Rotate(Geometry=g_move.Geometry, Angle=g_slider6, Plane=PlaneXY(0, 0, 0))  # -> Geometry, Transform
g_move_3 = Move(Geometry=g_move.Geometry, Motion=g_box_corners_3.CornerC)  # -> Geometry, Transform
g_rotate_4 = Rotate(Geometry=g_move.Geometry, Angle=g_slider12, Plane=PlaneXY(0, 0, 0))  # -> Geometry, Transform
g_move_4 = Move(Geometry=g_rotate_2.Geometry, Motion=g_box_corners_4.CornerB)  # -> Geometry, Transform
g_vec2pt = Vector2Pt(PointA=g_box_corners_4.CornerE, PointB=g_box_corners_4.CornerG, Unitize=False)  # -> Vector, Length
g_move_5 = Move(Geometry=g_rotate_2.Geometry, Motion=Vector(0, 0, 10))  # -> Geometry, Transform
g_move_6 = Move(Geometry=g_rotate_3.Geometry, Motion=g_vec2pt.Vector)  # -> Geometry, Transform
