# Grasshopper definition tempTowerHamlets002.gh (Grasshopper 0.9.76)
# plug-ins: Embryo

# E02.
# 
# In this example the form generated is slightly more complex than E01 due to the inclusion of a divide component.
# 
# The settings component is also introduced.
box = Box2Pt(Plane=PlaneXY(0, 0, 0))
box_corners = BoxCorners()  # -> CornerA, CornerB, CornerC, CornerD, CornerE, CornerF, CornerG, CornerH
vec = VectorXYZ(XComponent=0, YComponent=0, ZComponent=0)  # -> Vector, Length; disabled
g_slider8 = Slider(-0.719, range=-10..10)
g_slider7 = Slider(-4.718, range=-10..10)
g_slider6 = Slider(-6.711, range=-10..10)
g_slider5 = Slider(-4.565, range=-10..10)
g_slider4 = Slider(-9.864, range=-10..10)
g_slider3 = Slider(8.224, range=-10..10)
g_slider2 = Slider(9.421, range=-10..10)
g_slider1 = Slider(-1.997, range=-10..10)
g_slider0 = Slider(-7.402, range=-10..10)

# ----
# Setting RemoveDead to True will remove any components that have either a warning or error flag (note: this is just a visibility toggle, such compoents will never be connected to once they are not clean).
# The settings component contains extra user preferences such as whether a preview is displayed, the parameter domains, grid size, etc...
toggle = BooleanToggle(True)
embryo = EmbryoSettings(
    Preview=True,
    SliderDomain=Domain(-10, 10),
    OneToOne=Toggle(True),
    GridX=Slider(119, range=0..1000),
    GridY=Slider(182, range=0..1000),
    RemoveDead=toggle,
    OnlyTerminals=Toggle(False))

embryo_2 = Embryo(
    Reset=Toggle(True),
    Sliders=Slider(9, range=0..100),
    Components=Slider(21, range=0..100),
    MetricGenes=2,
    TopologyGenes=2,
    FunctionGenes=2,
    Settings=embryo,
    RandomOveride=Slider(18, range=0..100))  # -> Iterations, Components
colstep = ColumnStep(Components=embryo_2.Components, LastColumn=Slider(6, range=0..10))
box_2 = CenterBox(Base=PlaneXY(0, 0, 0), X=Slider(9.504, range=0..100), Y=Slider(9.504, range=0..100), Z=5)
g_box_corners = BoxCorners(Box=box_2)  # -> CornerA, CornerB, CornerC, CornerD, CornerE, CornerF, CornerG, CornerH
pi = Pi(Factor=1)
box_3 = CenterBox(Base=PlaneXY(0, 0, 0), X=1, Y=5, Z=1)
g_box_corners_2 = BoxCorners(Box=box_3)  # -> CornerA, CornerB, CornerC, CornerD, CornerE, CornerF, CornerG, CornerH
g_box_corners_3 = BoxCorners(Box=box_3)  # -> CornerA, CornerB, CornerC, CornerD, CornerE, CornerF, CornerG, CornerH
g_box = Box2Pt(PointA=g_box_corners_3.CornerA, PointB=g_box_corners.CornerE, Plane=PlaneXY(0, 0, 0))
g_box_2 = Box2Pt(PointA=g_box_corners_2.CornerA, PointB=g_box_corners_3.CornerH, Plane=PlaneXY(0, 0, 0))
division = Division(A=pi, B=Slider(2, range=0..10))
parent_output = ParentOutput(O=box_2)
g_box_corners_4 = BoxCorners(Box=g_box_2)  # -> CornerA, CornerB, CornerC, CornerD, CornerE, CornerF, CornerG, CornerH
g_box_corners_5 = BoxCorners(Box=g_box_2)  # -> CornerA, CornerB, CornerC, CornerD, CornerE, CornerF, CornerG, CornerH
g_box_corners_6 = BoxCorners(Box=g_box_2)  # -> CornerA, CornerB, CornerC, CornerD, CornerE, CornerF, CornerG, CornerH
parent_output_2 = ParentOutput(O=division)
g_box_3 = Box2Pt(PointA=g_box_corners_5.CornerB, PointB=g_box_corners_3.CornerH, Plane=PlaneXY(0, 0, 0))
g_box_4 = Box2Pt(PointA=g_box_corners_4.CornerH, PointB=g_box_corners_6.CornerH, Plane=PlaneXY(0, 0, 0))
parent_output_3 = ParentOutput(O=box_3)
g_box_corners_7 = BoxCorners(Box=g_box_4)  # -> CornerA, CornerB, CornerC, CornerD, CornerE, CornerF, CornerG, CornerH
g_box_corners_8 = BoxCorners(Box=g_box_4)  # -> CornerA, CornerB, CornerC, CornerD, CornerE, CornerF, CornerG, CornerH
g_box_corners_9 = BoxCorners(Box=g_box_4)  # -> CornerA, CornerB, CornerC, CornerD, CornerE, CornerF, CornerG, CornerH
g_box_5 = Box2Pt(PointA=g_box_corners_2.CornerH, PointB=g_box_corners_8.CornerD, Plane=PlaneXY(0, 0, 0))
g_box_6 = Box2Pt(PointA=g_box_corners.CornerE, PointB=g_box_corners_8.CornerA, Plane=PlaneXY(0, 0, 0))
g_box_7 = Box2Pt(PointA=g_box_corners.CornerD, PointB=g_box_corners_8.CornerG, Plane=PlaneXY(0, 0, 0))
vec_2 = VectorXYZ(XComponent=0, YComponent=0, ZComponent=0)  # -> Vector, Length
g_box_corners_10 = BoxCorners(Box=g_box_6)  # -> CornerA, CornerB, CornerC, CornerD, CornerE, CornerF, CornerG, CornerH
g_box_corners_11 = BoxCorners(Box=g_box_5)  # -> CornerA, CornerB, CornerC, CornerD, CornerE, CornerF, CornerG, CornerH
g_box_8 = Box2Pt(PointA=g_box_corners_10.CornerH, PointB=g_box_corners_7.CornerB, Plane=PlaneXY(0, 0, 0))
tr = TypeRevealer(Input=vec_2.Vector)  # -> ComponentClass, ParameterTypeName, ParameterClass, VolatileDataType
