# Grasshopper definition E02a_0.2.0_RotatedBlocks.gh (Grasshopper 0.9.56)
# plug-ins: Embryo

# E02.
# 
# In this example the form generated is slightly more complex than E01 due to the inclusion of a divide component.
# 
# The settings component is also introduced.
pt = ConstructPoint(XCoordinate=0, YCoordinate=0, ZCoordinate=0)
pt_2 = ConstructPoint(XCoordinate=0, YCoordinate=0, ZCoordinate=0)
pl_3pt = Plane3Pt()
sdiff = SolidDifference()
sdiff_2 = SolidDifference()
box = CenterBox(Base=PlaneXY(0, 0, 0), X=1, Y=1, Z=1)
rotate = Rotate(Center=Point(0, 0, 0), From=Vector(1, 0, 0), To=Vector(0, 1, 0))  # -> Geometry, Transform
number_slider = Slider(76, range=0..100)
number_slider_2 = Slider(16, range=0..100)
g_slider15 = Slider(-8.108, range=-10..10)
g_slider14 = Slider(7.11, range=-10..10)
g_slider13 = Slider(1.187, range=-10..10)
g_slider12 = Slider(4.184, range=-10..10)
g_slider11 = Slider(5.315, range=-10..10)
g_slider10 = Slider(2.633, range=-10..10)
g_slider9 = Slider(7.909, range=-10..10)
g_slider8 = Slider(4.762, range=-10..10)
g_slider7 = Slider(-0.93, range=-10..10)
g_slider6 = Slider(0.327, range=-10..10)
g_slider5 = Slider(-2.19, range=-10..10)
g_slider4 = Slider(8.873, range=-10..10)
g_slider3 = Slider(4.1, range=-10..10)
g_slider2 = Slider(5.916, range=-10..10)
g_slider1 = Slider(-6.502, range=-10..10)
g_slider0 = Slider(8.429, range=-10..10)

# ----
# Setting RemoveDead to True will remove any components that have either a warning or error flag (note: this is just a visibility toggle, such compoents will never be connected to once they are not clean).
# The settings component contains extra user preferences such as whether a preview is displayed, the parameter domains, grid size, etc...
toggle = BooleanToggle(True)
embryo = EmbryoSettings(
    Preview=True,
    SliderDomain=Domain(-10, 10),
    OneToOne=False,
    GridX=120,
    GridY=120,
    RemoveDead=toggle,
    OnlyTerminals=Toggle(True))

embryo_2 = Embryo(
    Reset=Toggle(True),
    Sliders=number_slider_2,
    Components=number_slider_2,
    MetricGenes=2,
    TopologyGenes=2,
    FunctionGenes=2,
    Settings=embryo,
    RandomOveride=Slider(31, range=0..100))  # -> Iterations, Components
g_box = CenterBox(Base=PlaneXY(0, 0, 0), X=g_slider12, Y=g_slider1, Z=g_slider13)
g_box_2 = CenterBox(Base=PlaneXY(0, 0, 0), X=g_slider1, Y=g_slider8, Z=g_slider0)
g_pt = ConstructPoint(XCoordinate=g_slider5, YCoordinate=g_slider3, ZCoordinate=g_slider9)
g_pt_2 = ConstructPoint(XCoordinate=g_slider0, YCoordinate=g_slider7, ZCoordinate=g_slider6)
g_box_3 = CenterBox(Base=PlaneXY(0, 0, 0), X=g_slider2, Y=g_slider4, Z=g_slider8)
g_sdiff = SolidDifference(BrepsA=g_box_2, BrepsB=g_box_3)
g_rotate = Rotate(Geometry=g_box_3, Center=g_pt_2, From=Vector(1, 0, 0), To=Vector(0, 1, 0))  # -> Geometry, Transform
