# Grasshopper definition E07_0.2.0_CountdownWithGalapagos.gh (Grasshopper 0.9.56)
# plug-ins: Embryo

# E07.
# 
# In this example, we use Embryo to solve a combinatorial problem - that of the numbers game of UK TV show Countdown.
# 
# Double-click on the galapagos component to start, making sure to minimise the problem not maximise!
# 
# The genome for the optimisation is the random topology input. The fitness is the absolute distance from the target result (314).
# 
# As currently the topology seed is random, it is only solved by brute-force, but this will change in later releases.
# 
# Also note the use of the One-to-One setting.
addition = Addition()
multiplication = Multiplication()
addition_2 = Addition()
subtraction = Subtraction()
addition_3 = Addition()

# ----
# The One-to-one setting means only one output parameter can be connected to one input parameter.
toggle = BooleanToggle(True)
embryo = EmbryoSettings(Preview=True, SliderDomain=Domain(-10, 10), OneToOne=toggle, GridX=100, GridY=70, RemoveDead=False)

# ----
# "I'll have one from the top and two from the bottom please Carol."
slider = Slider(4, range=0..4)
slider_2 = Slider(5, range=0..5)
slider_3 = Slider(6, range=0..6)
slider_4 = Slider(7, range=0..7)
slider_5 = Slider(25, range=0..25)
slider_6 = Slider(50, range=0..50)
parent_output = ParentOutput(O=[slider, slider_2, slider_3, slider_4, slider_5, slider_6])

# ----
# Set to True
toggle_2 = BooleanToggle(True)

# ----
# Tweak Seed to Explore
slider_7 = Slider(57846064, range=0..100000000)

# ----
# Known solutions
number_slider = Slider(36174833, range=0..100000000)
number_slider_2 = Slider(44981773, range=0..100000000)

embryo_2 = Embryo(
    Reset=toggle_2,
    Sliders=Slider(0, range=0..100),
    Components=Slider(5, range=0..10),
    MetricSeed=2,
    TopologySeed=slider_7,
    Settings=embryo)  # -> Iterations, Components
g_a_b = Addition(A=slider_2, B=slider)
g_a_b_2 = Addition(A=slider_4, B=slider_3)
g_a_b_3 = Addition(A=slider_5, B=slider_6)
g_a_b_4 = Addition(A=g_a_b_3, B=g_a_b_2)
target = Slider(314, range=0..1000)
g_a_b_5 = Subtraction(A=g_a_b, B=g_a_b_4)
galapagos = Galapagos(fitness=num, gene=slider_7)

# ----
# A Parent Input attaches itself to an output parameter in the child graph.
parent_input = ParentInput()

subtraction_2 = Subtraction(A=target, B=[parent_input, g_a_b_5])
abs = Absolute(Value=subtraction_2)
num = Number(abs)

pt = PointXYZ(XComponent=expr("x/5", abs), YComponent=0, ZComponent=0, System=PlaneXY(0, 0, 0))
pt_2 = PointXYZ(XComponent=0, YComponent=10, ZComponent=10, System=PlaneXY(0, 0, 0))
panel = Panel("(For visulising progress)")
box = Box2Pt(PointA=pt, PointB=pt_2, Plane=PlaneXY(0, 0, 0))
