# Grasshopper definition E09_0.2.0_CogniseGraphComponents.gh (Grasshopper 0.9.56)
# plug-ins: Embryo

# E09
# 
# This example is designed to introduce the cognition components in Embryo, that is, helping to understand the graph that has been generated.
# 
# These will in time become a set of components that can also be used to understand generative models made from other consultants (for example between architects and engineers).
# 
# It just so happens that within a meta-generative model, to some extent, the machine's result becomes something we must cognise ;)
pt = PointXYZ(XComponent=0, YComponent=0, ZComponent=0, System=PlaneXY(0, 0, 0))
pt_2 = PointXYZ(XComponent=0, YComponent=0, ZComponent=0, System=PlaneXY(0, 0, 0))
pl_3pt = Plane3Pt()
box = Box2Pt(Plane=PlaneXY(0, 0, 0))
slider = Slider(41931, range=0..100000)
embryo = Embryo(
    Reset=Toggle(False),
    Sliders=Slider(10, range=0..10),
    Components=Slider(45, range=0..100),
    MetricSeed=slider,
    TopologySeed=slider,
    Settings=null)  # -> Iterations, Components

# ----
# Slide me!
# ComponentStep will step through each component in order of creation one by one.
slider_2 = Slider(12, range=0..100)
cstep = ComponentStep(Instances=embryo.Components, LastComponent=slider_2)

# ----
# Then enable me...
# Column Step will step through each column (i.e. rank) of the graph one by one.
number_slider = Slider(5, range=0..10)
colstep = ColumnStep(Components=embryo.Components, LastColumn=number_slider)  # disabled
