# Grasshopper definition E10_0.2.0_GetChildGeometryBoxes.gh (Grasshopper 0.9.56)
# plug-ins: Embryo

# E10
# 
# This example shows how geometry can be got from the child graph and returned to the parent.
# 
# This is similar to the parent input, all though instead of searching for a single input it will get everything that is geometry based.
# 
# This component is experimental and will be  refined in time.
box = Box2Pt(Plane=PlaneXY(0, 0, 0))
pt = ConstructPoint(XCoordinate=0, YCoordinate=0, ZCoordinate=0)
pt_2 = ConstructPoint(XCoordinate=0, YCoordinate=0, ZCoordinate=0)

# ----
# In this example, we don't need to preview the base geometry because all we want is the union result (see right).
number_slider = Slider(80, range=0..100)
embryo = EmbryoSettings(Preview=Toggle(False), SliderDomain=Domain(-10, 10), OneToOne=False, GridX=120, GridY=number_slider, RemoveDead=False)

g_slider7 = Slider(-0.348, range=-10..10)
g_slider6 = Slider(3.188, range=-10..10)
g_slider5 = Slider(0.649, range=-10..10)
g_slider4 = Slider(-9.166, range=-10..10)
g_slider3 = Slider(3.616, range=-10..10)
g_slider2 = Slider(0.875, range=-10..10)
g_slider1 = Slider(7.187, range=-10..10)
g_slider0 = Slider(-4.711, range=-10..10)
embryo_2 = Embryo(
    Reset=Toggle(False),
    Sliders=8,
    Components=Slider(14, range=0..100),
    MetricSeed=Slider(24, range=0..100),
    TopologySeed=Slider(69, range=0..100),
    Settings=embryo)  # -> Iterations, Components
g_pt = ConstructPoint(XCoordinate=g_slider2, YCoordinate=g_slider4, ZCoordinate=g_slider5)
g_pt_2 = ConstructPoint(XCoordinate=g_slider3, YCoordinate=g_slider7, ZCoordinate=g_slider0)
g_pt_3 = ConstructPoint(XCoordinate=g_slider7, YCoordinate=g_slider1, ZCoordinate=g_slider4)
g_pt_4 = ConstructPoint(XCoordinate=g_slider2, YCoordinate=g_slider5, ZCoordinate=g_slider6)
g_pt_5 = ConstructPoint(XCoordinate=g_slider1, YCoordinate=g_slider4, ZCoordinate=g_slider0)
g_pt_6 = ConstructPoint(XCoordinate=g_slider0, YCoordinate=g_slider6, ZCoordinate=g_slider7)
g_pt_7 = ConstructPoint(XCoordinate=g_slider3, YCoordinate=g_slider5, ZCoordinate=g_slider2)
g_pt_8 = ConstructPoint(XCoordinate=g_slider4, YCoordinate=g_slider5, ZCoordinate=g_slider1)
g_pt_9 = ConstructPoint(XCoordinate=g_slider7, YCoordinate=g_slider6, ZCoordinate=g_slider0)
g_box = Box2Pt(PointA=g_pt_4, PointB=g_pt_5, Plane=PlaneXY(0, 0, 0))
g_box_2 = Box2Pt(PointA=g_pt_5, PointB=g_pt_9, Plane=PlaneXY(0, 0, 0))
g_box_3 = Box2Pt(PointA=g_pt_4, PointB=g_pt_9, Plane=PlaneXY(0, 0, 0))
g_box_4 = Box2Pt(PointA=g_pt_7, PointB=g_pt_9, Plane=PlaneXY(0, 0, 0))
g_box_5 = Box2Pt(PointA=g_pt_9, PointB=g_pt_8, Plane=PlaneXY(0, 0, 0))
get_geometry = GetGeometry(G=[g_box_5, g_box_4, g_box_3, g_box_2, g_box])

# ----
# Unions only solids with non-zero volume (avoids flat solids).
# 
# (there may be a better way of doing this)
boxprop = BoxProperties(Box=get_geometry)  # -> Center, Diagonal, Area, Volume, Degeneracy
larger = LargerThan(FirstNumber=boxprop.Volume, SecondNumber=0)  # -> LargerThan, OrEqualTo
p_n_c = PickNChoose(Pattern=larger.LargerThan, Stream1=get_geometry)
clean = CleanTree(Tree=p_n_c, CleanInvalid=True, CleanEmpty=False)
sunion = SolidUnion(Breps=clean)
