# Grasshopper definition TSP002.gh (Grasshopper 0.9.70)
# plug-ins: Embryo

addition = Addition()
g_slider2 = Slider(2, range=-10..10)
g_slider1 = Slider(2, range=-10..10)
g_slider0 = Slider(2, range=-10..10)
genes = GenePool(Decimals=0, Maximum=8, Minimum=0, Value=[2, 6, 0, 2, 2, 0, 1, 4, 4, 4])
embryo = EmbryoSettings(Preview=True, SliderDomain=Domain(-10, 10), OneToOne=True, GridX=120, GridY=120, RemoveDead=False, OnlyTerminals=False)
pt = Point(Point(21.51688606, 7.878490587, 0))
pt_2 = Point(Point(9.997076292, 9.599841472, 0))
pt_3 = Point(Point(-15.95559858, 9.732253079, 0))
pt_4 = Point(Point(-5.637596974, -3.40733883, 0))
pt_5 = Point(Point(3.53124206, 4.646371132, 0))
pt_6 = Point(Point(0.3097580755, 12.45227463, 0))
pt_7 = Point(Point(14.31082309, 1.300983917, 0))
parent_output = ParentOutput(O=[pt_4, pt_7, pt_5, pt_6, pt_2, pt, pt_3])
embryo_2 = Embryo(
    Reset=Toggle(True),
    Sliders=3,
    Components=1,
    MetricGenes=2,
    TopologyGenes=genes,
    FunctionGenes=2,
    Settings=embryo,
    RandomOveride=0)  # -> Iterations, Components
parent_input = ParentInput()
pt_8 = Point([parent_input, pt_6])
pt_9 = Point([parent_input, pt_7])
pt_10 = Point([parent_input, pt_4])
pt_11 = Point([parent_input, pt_2])
pt_12 = Point([parent_input, pt_3])
pt_13 = Point([parent_input, pt])
pt_14 = Point([parent_input, pt_5])
pline = PolyLine(Vertices=[pt_14, pt_10, pt_8, pt_9, pt_13, pt_11, pt_12], Closed=True)
galapagos = Galapagos(fitness=len, gene=genes)
g_a_b = Addition(A=g_slider2, B=g_slider0)
len = Length(Curve=pline)
